# Grasshopper definition ADU Calculator.gh (Grasshopper 1.0.7)
# plug-ins: ShapeDiverForGrasshopper

distance_x = Slider(5, range=0..20)
distance_y = Slider(5, range=0..20)
width = Slider(14, range=0..20)
length = Slider(18, range=0..20)
existing_house = Brep([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])
paving = Brep([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])
heigth = Slider(20, range=0..100)
addition = Addition(A=distance_x, B=width)
addition_2 = Addition(A=distance_y, B=length)

construct_point = ConstructPoint(XCoordinate=distance_x, YCoordinate=expr("-x", distance_y), ZCoordinate=0)
construct_point_2 = ConstructPoint(XCoordinate=addition, YCoordinate=expr("-x", addition_2), ZCoordinate=0)
rectangle_2pt = Rectangle2Pt(Plane=PlaneXY(0, 0, 0), PointA=construct_point, PointB=construct_point_2, Radius=0)  # -> Rectangle, Length

unit_z = UnitZ(Factor=heigth)
curve = Curve(rectangle_2pt.Rectangle)
extrude = Extrude(Base=curve, Direction=unit_z)
cap_holes = CapHoles(Brep=extrude)
contour = Contour(Shape=cap_holes, Point=Point(0, 0, 0), Direction=Vector(0, 0, 1), Distance=10)
unit_z_2 = UnitZ(Factor=1)
extrude_2 = Extrude(Base=contour, Direction=unit_z_2)
cap_holes_2 = CapHoles(Brep=extrude_2)
metalness = Slider(0, range=0..1)
roughness = Slider(1, range=0..1)
opacity = Slider(1, range=0..1)
metalness_2 = Slider(0, range=0..1)
roughness_2 = Slider(1, range=0..1)
opacity_2 = Slider(0.25, range=0..1)
box_color = ColourSwatch(SwatchColor=RGB(255, 255, 255))
box_color_2 = ColourSwatch(SwatchColor=RGB(255, 255, 255))
# Grasshopper components: All the standard Grasshopper components can be used in your definitions.
# 
# Make sure to hide the preview for all components except for the final preview compononents.
# ShapeDiver material components: Use Preset Material, ShapeDiver Material or glTF 2.0 Material to define optimized materials for online rendering.
# 
# All PBR textures can be specified.
shapediver_material = ShapeDiverMaterial(Color=box_color, Metalness=metalness, Roughness=roughness, Opacity=opacity, FlatShading=False)
shapediver_material_2 = ShapeDiverMaterial(Color=box_color_2, Metalness=metalness_2, Roughness=roughness_2, Opacity=opacity_2, FlatShading=False)

# ----
# Meshing: Brep geometry is automatically converted to meshes when the model is uploaded to ShapeDiver. Therefore, achieve better performance and visual results by meshing all outputs manually whenever possible.
# ShapeDiver Display vs. glTF 2.0 Display: Read more about the differences between those two display approaches here:
# https://help.shapediver.com/doc/Display.1842479137.html
settings_speed = SettingsSpeed()
mesh_brep = MeshBrep(Brep=cap_holes_2, Settings=settings_speed)

settings_speed_2 = SettingsSpeed()
mesh_brep_2 = MeshBrep(Brep=cap_holes, Settings=settings_speed_2)

# ----
# Preview: You can use the Grasshopper 'Custom Preview' component along with the 'Create Material' component to display your geometry. However, we recommend using the display components from the ShapeDiver plugin.
# ShapeDiver display components: Use ShapeDiver Display or glTF 2.0 Display to create previews compatible with the ShapeDiver materials.
sddisplaygeometry = ShapeDiverDisplayGeometry(Geometry=mesh_brep, ShapeDiverMaterial=shapediver_material)

sddisplaygeometry_2 = ShapeDiverDisplayGeometry(Geometry=mesh_brep_2, ShapeDiverMaterial=shapediver_material_2)
