# Grasshopper definition Massing Design Calculator 0.6.gh (Grasshopper 1.0.7)
# plug-ins: Human, EleFront, PlanFinderGH

pipeline = GeometryPipeline(
    GroupByLayer=False,
    GroupByType=False,
    IncludeHidden=True,
    IncludeLocked=True,
    LayerFilter="02_MASSING",
    NameFilter="*",
    SublayerFiltering=True,
    TypeFilter=1073741848)

# ---- group: Import Mass as PolySurface
massing = Brep(simplify(graft(pipeline)))

# ----
_1st_stack_floor_height = DigitScroller(Scroller_Digits=12, Scroller_Prefix="1st Stack Floor Height", Scroller_Radix=11, Scroller_Value=0)
no_of_floors = DigitScroller(Scroller_Digits=12, Scroller_Prefix="No. Of Floors", Scroller_Radix=11, Scroller_Value=0)
_2nd_stack_floor_height = DigitScroller(Scroller_Digits=12, Scroller_Prefix="2nd Stack Floor Height", Scroller_Radix=11, Scroller_Value=0)
no_of_floors_2 = DigitScroller(Scroller_Digits=12, Scroller_Prefix="No. Of Floors", Scroller_Radix=11, Scroller_Value=0)
typical_floor_height = DigitScroller(Scroller_Digits=12, Scroller_Prefix="Typical Floor Height", Scroller_Radix=11, Scroller_Value=10)
omit_last_floor_slab = BooleanToggle(True)

# ---- group: Residential Calculator
land_value = DigitScroller(Scroller_Digits=12, Scroller_Prefix="Land Value", Scroller_Radix=11, Scroller_Value=700000)
hard_vs_soft_coef = DigitScroller(Scroller_Digits=12, Scroller_Prefix="Hard vs Soft Coef", Scroller_Radix=11, Scroller_Value=70)
construction_cost_per_sf = DigitScroller(Scroller_Digits=12, Scroller_Prefix="Construction Cost Per SF", Scroller_Radix=11, Scroller_Value=375)
sale_price_per_sf = DigitScroller(Scroller_Digits=12, Scroller_Prefix="Sale Price Per SF", Scroller_Radix=11, Scroller_Value=975)
rent_per_sf = DigitScroller(Scroller_Digits=12, Scroller_Prefix="Rent Per SF", Scroller_Radix=10, Scroller_Value=4.25)
cap_rate = DigitScroller(Scroller_Digits=12, Scroller_Prefix="Cap Rate", Scroller_Radix=11, Scroller_Value=5)
net_coefficient = DigitScroller(Scroller_Digits=12, Scroller_Prefix="Net Coefficient", Scroller_Radix=11, Scroller_Value=85)

# ----
total_parking_area = DigitScroller(Scroller_Digits=12, Scroller_Prefix="Total Parking Area", Scroller_Radix=11, Scroller_Value=2400)
construction_cost_per_sf_parking = DigitScroller(Scroller_Digits=12, Scroller_Prefix="Construction Cost Per SF Parking", Scroller_Radix=11, Scroller_Value=125)
panel = Panel("""3
5""")
cluster = Cluster(
    massing=massing,
    _1st_stack_floor_height=_1st_stack_floor_height,
    no_of_floors=no_of_floors,
    _2nd_stack_floor_height=_2nd_stack_floor_height,
    no_of_floors_2=no_of_floors_2,
    typical_floor_height=typical_floor_height,
    bool=omit_last_floor_slab,
    total_parking_area=total_parking_area,
    cpsf=construction_cost_per_sf,
    cpsf_parking=construction_cost_per_sf_parking,
    ppsf=sale_price_per_sf,
    rpsf=rent_per_sf,
    cap_rate=cap_rate,
    net_coef=net_coefficient,
    land_value=land_value,
    hard_soft_coef=hard_vs_soft_coef)  # -> facade_attributes_2, points_facade_attributes, walls_2, roof, floors_2, floor_plate_curves, L

# ---- group: Residential Calculator
panel_2 = Panel(cluster.L)

# ----
number_slider = Slider(3, range=0..10)
lng = ListLength(List=cluster.L)
series = Series(Start=0, Step=expr("x+2", number_slider), Count=lng)
Z = UnitZ(Factor=series)
pt = Point(<point referenced from the Rhino model>)
move = Move(Geometry=pt, Motion=Z)  # -> Geometry, Transform

output_floors = Brep(cluster.floors_2)

# ---- group: Output - Walls
walls = Surface(simplify(cluster.walls_2))

# ----
output_roof = Brep(cluster.roof)

# ---- group: Output - Floors As Curve
crv = Curve(cluster.floor_plate_curves)

# ----
preview = CustomPreview(Geometry=cluster.walls_2, Material=ColourSwatch(SwatchColor=RGBA(191, 191, 191, 126)))  # disabled
preview_2 = CustomPreview(Geometry=output_roof, Material=ColourSwatch(SwatchColor=RGB(125, 125, 125)))
preview_3 = CustomPreview(Geometry=output_floors, Material=ColourSwatch(SwatchColor=RGB(164, 212, 126)))
screentext = ScreenOrientedText(
    Text=reverse(cluster.L),
    Justification=7,
    Location=move.Geometry,
    SizeFactor=number_slider,
    Depth=0,
    Absolute=Toggle(True))
typical_units = Curve(reparameterize(crv))
corridor_curve = Curve(<curve referenced from the Rhino model>)
output_roof_2 = Brep(cluster.roof)
item = ListItem(List=corridor_curve, Index=0, Wrap=True)  # -> Item, Item1
debrep = DeconstructBrep(Brep=output_roof_2)  # -> Faces, Edges, Vertices
tweencrv = TweenCurve(CurveA=item.Item, CurveB=item.Item1, Factor=0.5, BlendType=0)  # -> simplify(graft(Tween))
trim = TrimTree(Tree=typical_units, Depth=1)
evalsrf = EvaluateSurface(Surface=reparameterize(debrep.Faces), Point="{0.5,0.5,0}")  # -> Point, Normal, UDirection, VDirection, Frame
hatchtable = HatchTable(Update=True)
distributefaces = GhPythonScript(v=evalsrf.Normal, faces=debrep.Faces)  # -> floors, facadeWalls, roof; inputs v: list, faces: list; same code as distributefaces
wires = BrepWireframe(Brep=distributefaces.roof, Density=-1)
join = JoinCurves(Curves=wires, Preserve=False)
item_2 = ListItem(List=hatchtable, Index=Slider(4, range=0..10), Wrap=True)
python = GhPythonScript(unit_outlines=trim, corridor_curve=tweencrv)  # -> entrance_points, facade_points, corner_points; inputs unit_outlines: list of Curve, corridor_curve: Curve
# ---------- python: Python ----------
__author__ = "ilouh"
__version__ = "2023.02.21"

import rhinoscriptsyntax as rs
import Grasshopper as gh
import Rhino.Geometry as rg
import ghpythonlib.components as comps
import math

entrance_points = []
corner_points = [] 
facade_points = [] 

for outline in unit_outlines:
    
    walls = comps.Explode(outline,True)
    walls = walls['segments']
    
    mid_points = comps.CurveMiddle(walls)

    
    sorted_points = comps.CurveClosestPoint(mid_points,corridor_curve)
    
    distances = sorted_points['distance']
    points = sorted_points['point']
    
    combined = zip(distances, mid_points)
    sorted_combined = sorted(combined, key=lambda x: x[0])
    sorted_distances, sorted_points = zip(*sorted_combined)

    entrance_points.append(sorted_points[0])
    facade_points.append(sorted_points[-1])
    corner_points.append(sorted_points[1])
    #print(sorted_distances)

#door_entrances = [] 

#for entrance,outline in zip(entrance_points,unit_outlines):
    
#    entrance_unit = comps.CurveClosestPoint(entrance,outline)
#    entrance_unit = entrance_unit['point']
#    
#    door_entrances.append(entrance_unit)
# ---------- end python ----------
hatch = DefineHatch(Curve=join, Pattern=item_2, Rotation=0, Scale=Slider(8, range=0..10))
fsettings = FitSettings(WidthInterior=100, WidthExterior=200, DownScaling=0.8, UpScaling=1.2, ThresholdScore=0, AmountOptions=3, UnitSystem=4)

panel_3 = Panel("""Iliya Muzychuk
Brooks + Scarpa Architects
iliya@brooksscarpa.com""")
item_3 = ListItem(List=panel_3, Index=0, Wrap=True)  # -> Item, Item1, Item2
activate_license = Activate(FullName=item_3.Item, Company=item_3.Item1, EmailAddress=item_3.Item2)
crv_2 = Curve(simplify(crv))
fit = PlanFit(
    Boundary=simplify(graft(crv_2)),
    EntranceS=simplify(graft(python.entrance_points)),
    Beds=-1,
    Baths=1,
    Country=15,
    FitSettings=fsettings,
    InHousePlans=False)
item_4 = ListItem(List=fit, Index=Slider(0, range=0..10), Wrap=True)
deplan = DeconstructPlan(Plan=item_4)  # -> InteriorWalls, ExteriorWalls, DoorCurves, Glass, WindowFrames, Furniture, Score, Rooms

curvepoint = PointOnCurve(crv_2, parameter=0.5)
exterior_walls = Curve(deplan.ExteriorWalls)
interior_walls = Curve(deplan.InteriorWalls)
furniture = Curve(deplan.Furniture)
previewlw = CustomPreviewLineweights(Geometry=furniture, Shader=ColourSwatch(SwatchColor=RGB(6, 0, 255)), Absolute=False)
previewlw_2 = CustomPreviewLineweights(Geometry=interior_walls, Shader=ColourSwatch(SwatchColor=RGB(192, 192, 192)), Absolute=False)
previewlw_3 = CustomPreviewLineweights(Geometry=exterior_walls, Shader=ColourSwatch(SwatchColor=RGB(6, 0, 0)), Absolute=False)

python_2 = GhPythonScript(
    hard_soft_coef=hard_vs_soft_coef,
    costruction_costs_per_sf=construction_cost_per_sf,
    costruction_costs_per_sf_parking=construction_cost_per_sf_parking,
    sale_price_per_sf=sale_price_per_sf,
    rent_price_per_sf=rent_per_sf,
    cap_rate=cap_rate,
    net_coef=net_coefficient)  # -> values
# ---------- python_2: Python ----------
__author__ = "ilouh"
__version__ = "2023.02.21"

import rhinoscriptsyntax as rs
import Grasshopper as gh
import Rhino.Geometry as rg
import ghpythonlib.components as comps
import math



def format_to_dollar_price(value):
    if isinstance(value, (int, float)):
        formatted_value = "${:,.2f}".format(value)
    elif isinstance(value, str):
        # Remove any non-numeric characters
        value = ''.join(filter(str.isdigit, value))
        if value:
            formatted_value = "${:,.2f}".format(float(value)/100)
        else:
            formatted_value = "$0.00"
    else:
        raise TypeError("Unsupported value type. Only int, float, and str are supported.")
    
    return formatted_value

def float_to_percentage(number):
    percentage = number * 100
    formatted_percentage = "{:.2f}%".format(percentage)
    return formatted_percentage

#_______________________________________________________________________________________

# Create a dictionary to store the calculated values

data_dict = {

    'hard_vs_soft_coef': float_to_percentage(hard_soft_coef/100),
    'costruction_costs_per_sf': format_to_dollar_price(costruction_costs_per_sf),
    'costruction_costs_per_sf_parking': format_to_dollar_price(costruction_costs_per_sf_parking),
    'sale_price_per_sf': format_to_dollar_price(sale_price_per_sf),
    'rent_price_per_sf': format_to_dollar_price(rent_price_per_sf),
    'cap_rate': float_to_percentage(cap_rate/100),
    'net_vs_gross_coef': float_to_percentage(net_coef/100)
}

# Create a dataframe from the dictionary

values = []

keys_list = [

    'costruction_costs_per_sf',
    'costruction_costs_per_sf_parking',
    'sale_price_per_sf',
    'rent_price_per_sf',
    'cap_rate',
    'net_vs_gross_coef',
    'hard_vs_soft_coef'
]

for item in keys_list:
    values.append(item + ': ' + str(data_dict[item]))
# ---------- end python_2 ----------

ins = InsertItems(List=python_2, Indices=panel, Wrap=True)

panel_4 = Panel(ins)

# ==== cluster Cluster
_1st_stack_floor_height = ClusterInput()
no_of_floors = ClusterInput()
no_of_floors_2 = ClusterInput()
typical_floor_height = ClusterInput()
_2nd_stack_floor_height = ClusterInput()
massing = ClusterInput()
massing_2 = Brep(graft(massing))
_1st_stack_floor_height_2 = Integer(_1st_stack_floor_height)
no_of_floors_3 = Integer(no_of_floors_2)
no_of_floors_4 = Integer(no_of_floors)
_2nd_stack_floor_height_2 = Integer(_2nd_stack_floor_height)
typical_floor_height_2 = Integer(typical_floor_height)

# ---- group: Calculates Building Height
bbox = BoundingBox(Content=massing_2, Plane=PlaneXY(0, 0, 0), UnionBox=True)  # -> Box, Box_2
box_corners = BoxCorners(Box=bbox.Box)  # -> CornerA, CornerB, CornerC, CornerD, CornerE, CornerF, CornerG, CornerH
dist = Distance(PointA=box_corners.CornerA, PointB=box_corners.CornerE)

# ----
pdecon = Deconstruct(Point=box_corners.CornerA)  # -> XComponent, YComponent, ZComponent

# ---- group: This Python Component Create the Contour Lines
python = GhPythonScript(
    First_Stack_Floor_Height=_1st_stack_floor_height_2,
    First_Stack_No_Floors=no_of_floors_4,
    Second_Stack_Floor_Height=_2nd_stack_floor_height_2,
    Second_Stack_No_Floors=no_of_floors_3,
    Typical_Floor_Height=typical_floor_height_2,
    Overall_Building_Height=dist,
    start_value_z=pdecon.ZComponent)  # -> Distances, intersection_Planes
# ---------- python: Python ----------
__author__ = "Iliya Muzychuk"
__version__ = "2023.02.03"

import rhinoscriptsyntax as rs
import Grasshopper as gh
import Rhino.Geometry as rg
import ghpythonlib.components as comps
import math

#Variable Declaration

First_Stack_Floor_Height = First_Stack_Floor_Height
First_Stack_No_Floors = First_Stack_No_Floors
Second_Stack_Floor_Height = Second_Stack_Floor_Height
Second_Stack_No_Floors = Second_Stack_No_Floors
Typical_Floor_Height = Typical_Floor_Height
Overall_Building_Height = Overall_Building_Height


#Creates a list of distances for contouring. 

Distances = [0]

#Creates the list of first stack floors 

for i in range(0, int(First_Stack_No_Floors)):
    
    temp_height = (i + 1) * First_Stack_Floor_Height
    print(temp_height)
    Distances.append(temp_height)

#Appends the list the second stack floors 
for i in range(0, int(Second_Stack_No_Floors)):
    
    temp_height = Distances[-1] + Second_Stack_Floor_Height
    Distances.append(temp_height)

remaining_floors = math.floor((round(Overall_Building_Height) - Distances[-1])/Typical_Floor_Height)

for i in range(0, int(remaining_floors)):
    
    temp_height = Distances[-1] + Typical_Floor_Height
    Distances.append(temp_height)
    
#print(remaining_floors)
#print(Distances)

intersection_Planes = []

intersection_Planes = []

for i in range(0,len(Distances)): 
    
    Distances[i] = Distances[i] + start_value_z
    
for z in Distances: 
    
    point = comps.ConstructPoint(0,0,z)
    print(point)
    plane = comps.XYPlane(point)
    intersection_Planes.append(plane)
# ---------- end python ----------

# ---- group: creates intersetions for floors
mesh = MeshBrep(
    Brep=massing_2,
    Settings={GridMaxCount=0, GridMinCount=16, JaggedSeams=False, MaxEdgeLength=0, MinEdgeLength=0.0001, MinTolerance=0, Refine=True, RefineAngle=0, RelativeTolerance=0.65, SimplePlanes=True, Tolerance=0})
xy = XYPlane(Origin=python.intersection_Planes)
sec = MeshPlane(Mesh=mesh, Plane=xy)  # -> simplify(Curves)

# ---- group: Isolate Faces of Mass
debrep = DeconstructBrep(Brep=massing_2)  # -> Faces, Edges, Vertices
evalsrf = EvaluateSurface(Surface=reparameterize(debrep.Faces), Point="{0.5,0.5,0}")  # -> Point, Normal, UDirection, VDirection, Frame
distributefaces = GhPythonScript(v=evalsrf.Normal, faces=debrep.Faces)  # -> floors, facadeWalls, roof; inputs v: list, faces: list
# ---------- distributefaces: Python ----------
__author__ = "ilouh"
__version__ = "2023.01.08"

import rhinoscriptsyntax as rs
import ghpythonlib.components as comps
import Rhino.Geometry as geom

#elements = comps.DeconstructBrep(mass)
#faces = elements['faces']

#find the normal of each face


roof = []
floors = []
solidWalls = []
facadeWalls = [] 

for i in range(0,len(v)):
    
    
    values = comps.DeconstructVector(v[i])
    print(values)
    
    x_value = values['x_component']
    y_value = values['y_component']
    z_value = values['z_component']
    
    

    if z_value >= 0.4:
        
        print(i)
        roof.append(faces[i])
    
    if z_value == -1:
        
        floors.append(faces[i])
   
    if abs(z_value) != 1:
    
        facadeWalls.append(faces[i])
# ---------- end distributefaces ----------

# ----
floors_as_curves = Curve(sec)

# ---- group: Pass if Tree or List
flatten = FlattenTree(Tree=massing_2, Path="{0}")
python_2 = GhPythonScript(x=flatten)  # -> a; inputs x: list
# ---------- python_2: Python ----------
__author__ = "ilouh"
__version__ = "2023.02.21"

import rhinoscriptsyntax as rs
import Grasshopper as gh
import Rhino.Geometry as rg
import ghpythonlib.components as comps
import math

if len(x) > 1:
    a = True
else:
    a = False
# ---------- end python_2 ----------
trim = TrimTree(Tree=floors_as_curves, Depth=1)
flatten_2 = FlattenTree(Tree=floors_as_curves, Path="{0}")
filter = StreamFilter(Gate=python_2, Stream0=flatten_2, Stream1=trim)

# ----
srf = Surface(graft(distributefaces.facadeWalls))
srf_2 = Surface(flatten(distributefaces.roof))
trim_2 = TrimTree(Tree=srf, Depth=1)
bool = ClusterInput()

# ---- group: Calculates Gross Building Area
python_3 = GhPythonScript(Floor_Plate_Curves=filter, floorList=python.Distances, bool=bool)  # -> keys, simplify(values), TotalBuildingArea, Floor_Plate_Curves; inputs Floor_Plate_Curves: list of Curve, floorList: list of Int32
# ---------- python_3: Python ----------
__author__ = "Iliya Muzychuk"
__version__ = "2023.02.03"

import rhinoscriptsyntax as rs
import Grasshopper as gh
import Rhino.Geometry as rg
import ghpythonlib.components as comps

FloorNames = []
FloorAreas = []

#Funcition to find the key of a dictionary by value 

def findKey(value_to_find,dic):
    for key, value in dic.items():
        if abs(value - value_to_find) < 2:
            return key
dic = {}
#Create a name and claculates the area of each floor
for i in range(0,len(floorList)):
    floor_number = 1 + i
    dic_name = 'Floor {}'.format(floor_number)
    dic[dic_name] = floorList[i]

print(dic)

if bool == True: 

    Floor_Plate_Curves.pop(-1)

else:
    
    pass

for  floor in Floor_Plate_Curves: 
    
    
    Floor_Area = comps.Area(floor)
    FloorAreas.append(round(Floor_Area['area'],2))

    
    z_value = int(Floor_Area['centroid'][2])
    print(z_value)
    Floor_Name = findKey(z_value,dic)
    
    print(Floor_Name)

    FloorNames.append(Floor_Name)

keys = FloorNames
values = FloorAreas

TotalBuildingArea = sum(values)
# ---------- end python_3 ----------

# ---- group: creates the extrusion distance
floor_thickness = Slider(0.5, range=0..1)
neg = Negative(Value=floor_thickness)
Z = UnitZ(Factor=neg)
extr = Extrude(Base=python_3.Floor_Plate_Curves, Direction=Z)
cap = CapHoles(Brep=extr)

# ----
json_file_path = ClusterInput()
total_parking_area = ClusterInput()
cpsf = ClusterInput()
cpsf_parking = ClusterInput()
ppsf = ClusterInput()
rpsf = ClusterInput()
cap_rate = ClusterInput()
net_coef = ClusterInput()
land_value = ClusterInput()
hard_soft_coef = ClusterInput()
tstat = TreeStatistics(Tree=python_3.values)  # -> Paths, Length, Count
flatten_3 = FlattenTree(Tree=python_3.values, Path="{0}")
python_4 = GhPythonScript(
    areas=flatten_3,
    total_parking_area=total_parking_area,
    tree_paths=tstat.Paths,
    cpsf=cpsf,
    cpsf_parking=cpsf_parking,
    ppsf=ppsf,
    rpsf=rpsf,
    cap_rate=cap_rate,
    net_coef=net_coef,
    land_value=land_value,
    hard_soft_coef=hard_soft_coef,
    json_file_path=json_file_path)  # -> total_area, total_units, average_unit_size, average_unit_rent, average_unit_sale_value, land_value, construction_cost, soft_costs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; inputs areas: list, tree_paths: list
# ---------- python_4: Python ----------
__author__ = "ilouh"
__version__ = "2023.02.21"

import rhinoscriptsyntax as rs
import Grasshopper as gh
import Rhino.Geometry as rg
import ghpythonlib.components as comps
import math

#sum a list of numbers
def sum(numbers):
    total = 0
    for n in numbers:
        total += n
    return total


units = len(tree_paths)
total_area = sum(areas)

#Functions
def format_to_dollar_price(value):
    if isinstance(value, (int, float)):
        formatted_value = "${:,.2f}".format(value)
    elif isinstance(value, str):
        # Remove any non-numeric characters
        value = ''.join(filter(str.isdigit, value))
        if value:
            formatted_value = "${:,.2f}".format(float(value)/100)
        else:
            formatted_value = "$0.00"
    else:
        raise TypeError("Unsupported value type. Only int, float, and str are supported.")
    
    return formatted_value

def float_to_percentage(number):
    percentage = number * 100
    formatted_percentage = "{:.2f}%".format(percentage)
    return formatted_percentage

def format_to_sf_area(value):
    if isinstance(value, (int, float)):
        formatted_value = "{:,.2f} SF".format(value)
    else:
        raise TypeError("Unsupported value type. Only int and float are supported.")
    
    return formatted_value

#_______________________________________________________________________________________
# Calculations
average_unit_size = total_area / units  # Average size of each unit in square feet
average_rent = float(rpsf) * total_area / units  # Average monthly rent per unit
unit_sale_value = average_unit_size * ppsf  # Sale value of each unit

project_valuation = (average_rent * units * (net_coef / 100) * 12) / (cap_rate / 100)  # Valuation of the project based on net operating income
construction_costs = total_area * cpsf  # Total construction costs for the project
soft_costs = construction_costs * ((100 - hard_soft_coef) / 100)  # Soft costs for the project
total_project_costs = land_value + construction_costs + soft_costs  # Total costs for the project

net_income = total_area * rpsf * 0.7 * 12 

# Create a dictionary to store the calculated values
data_dict = {
    'total__buildbale_area': format_to_sf_area(total_area),
    'total_parking_area': format_to_sf_area(total_parking_area),
    'total_units': units,
    'average_unit_size': format_to_sf_area(average_unit_size),
    'average_unit_rent': format_to_dollar_price(average_rent),
    'average_unit_sale_value': format_to_dollar_price(unit_sale_value),
    'land_value': format_to_dollar_price(land_value),
    'construction_cost': format_to_dollar_price(total_area * cpsf + total_parking_area * cpsf_parking),
    'soft_costs': format_to_dollar_price(soft_costs),
    'total_cost': format_to_dollar_price(total_project_costs),
    'sale_value': format_to_dollar_price(total_area * ppsf),
    'project_valuation': format_to_dollar_price(project_valuation),
    'gross_profit': format_to_dollar_price(total_area * ppsf - total_project_costs),
    'gross_margin': float_to_percentage((total_area * ppsf - total_project_costs) / (total_area * ppsf)),
    'gross_income' : format_to_dollar_price(total_area * rpsf * 12) ,
    'net_income' : format_to_dollar_price(net_income)
}

# Create a list of keys to iterate through
keys_list = [
    'total__buildbale_area',
    'total_parking_area',
    'total_units',
    'average_unit_size',
    'average_unit_rent',
    'average_unit_sale_value',
    'land_value',
    'construction_cost',
    'soft_costs',
    'total_cost',
    'sale_value',
    'project_valuation',
    'gross_profit',
    'gross_margin',
    'gross_income',
    'net_income'
]

# Iterate through the keys_list and retrieve corresponding values from the data_dict
values = []
for item in keys_list:
    values.append(item + ': ' + str(data_dict[item]))

# Print the values
print(values)
# ---------- end python_4 ----------
walls = Surface(simplify(trim_2))

extr_2 = Extrude(Base=srf_2, Direction=Z)
cap_2 = CapHoles(Brep=extr_2)

floors = Brep(simplify(cap))
panel = Panel(python_4.values)

# ---- group: Outputs
floor_plate_curves = ClusterOutput(python_3.Floor_Plate_Curves)
walls_2 = ClusterOutput(walls)
roof = ClusterOutput(cap_2)
floors_2 = ClusterOutput(floors)

# ----
flatten_4 = FlattenTree(Tree=python_3.TotalBuildingArea, Path="{0}")
panel_2 = Panel("""3
6
10
13""")
graft = GraftTree(Tree=flatten_4, IncludeEmptyLists=True, IncludeNullItems=True)

# ---- group: Calculates Wall Area Ratio
python_5 = GhPythonScript(walls=walls, totalBuildingArea=graft)  # -> keys, values, result; inputs walls: list
# ---------- python_5: Python ----------
__author__ = "Iliya Muzychuk"
__version__ = "2023.02.03"

import rhinoscriptsyntax as rs
import Grasshopper as gh
import Rhino.Geometry as rg
import ghpythonlib.components as comps

#A function to convert a float to percentage

def float_to_percentage(number):
    return '{:.2%}'.format(number)
    
wall_areas = []

for wall in walls:
    
    area = rs.Area(wall)
    wall_areas.append(area)

total_wall_area = round(sum(wall_areas),2)
wall_area_ratio = total_wall_area / totalBuildingArea

#Dictionary constructions allows future json file control 

dic = {

    'Total Facade Area' : total_wall_area,
    'Wall area/Floor area Ratio' : float_to_percentage(wall_area_ratio)

}

keys = dic.keys()
values = dic.values() 

result = []

for key, value in dic.items():
    
    string = str(key) + ": " + str(value)
    result.append(string)
# ---------- end python_5 ----------

# ----
ins = InsertItems(List=panel, Indices=panel_2, Wrap=True)
L = ClusterOutput(ins)
facade_attributes = Data(python_5.result)

lng = ListLength(List=simplify(facade_attributes))
series = Series(Start=0, Step=typical_floor_height_2, Count=lng)

Z_2 = UnitZ(Factor=series)
move = Move(Motion=Z_2)  # -> Points_Facade_Attributes, Transform

points_facade_attributes = ClusterOutput(move.Points_Facade_Attributes)
facade_attributes_2 = ClusterOutput(facade_attributes)
