# Grasshopper definition Program_Units 0.6.0.gh (Grasshopper 1.0.7)

pipeline = GeometryPipeline(
    GroupByLayer=False,
    GroupByType=False,
    IncludeHidden=True,
    IncludeLocked=True,
    LayerFilter="05_DRAFTING*05_LW04 - Residential",
    NameFilter="*",
    SublayerFiltering=True,
    TypeFilter=4)
path_curve = Curve(reparameterize(simplify(graft(pipeline))))
corridor_depth = Slider(5, range=5..10)
unit_area = DigitScroller(Scroller_Digits=12, Scroller_Prefix="Unit Area", Scroller_Radix=9, Scroller_Value=850)
unit_width = DigitScroller(Scroller_Digits=12, Scroller_Prefix="Unit Width", Scroller_Radix=9, Scroller_Value=25)
unit_length = DigitScroller(Scroller_Digits=12, Scroller_Prefix="Unit Length", Scroller_Radix=9, Scroller_Value=42)
unit_height = DigitScroller(Scroller_Digits=12, Scroller_Prefix="Unit Height", Scroller_Radix=9, Scroller_Value=9)
true_by_unit_length_false_by_unit_area = BooleanToggle(False)
true_inboard_false_outboard = BooleanToggle(False)
true_single_loaded_false_double_loaded = BooleanToggle(False)
list = ValueList({"One": 0, "Two": 1, "Three": 2}, selected="One")
unit_layout_type_a = Curve([<curve referenced from the Rhino model> x2])
unit_layout_type_c = Curve([<curve referenced from the Rhino model> x11])
unit_layout_type_b = Curve([<curve referenced from the Rhino model> x18])
crv = Curve(graft(path_curve))
filter = StreamFilter(Gate=list, Stream0=unit_layout_type_a, Stream1=unit_layout_type_b, Stream2=unit_layout_type_c)

# ---- group: creates the curve offsets for units
python = GhPythonScript(
    guide_crv=crv,
    corridor_depth=corridor_depth,
    unit_area=unit_area,
    unit_width=unit_width,
    unit_length=unit_length,
    bool_calc=true_by_unit_length_false_by_unit_area,
    bool_dir=true_inboard_false_outboard)  # -> outer_curves, inner_curves; inputs guide_crv: Curve
# ---------- python: Python ----------
__author__ = "ilouh"
__version__ = "2023.02.21"

import rhinoscriptsyntax as rs
import Grasshopper as gh
import Rhino.Geometry as rg
import ghpythonlib.components as comps
import math


#Set the directionality of the curves 
#set up if the unit depth is calculated by reuiqred area or by preset depth

if bool_dir is True:
    coef = 1
else:
    coef = -1
    

if bool_calc is False:
    unit_depth = coef * math.ceil(unit_area/unit_width)
else:
    unit_depth = coef * unit_length

#__________________________________________________

offest_lengths = [

    0,
    unit_depth,
    unit_depth+corridor_depth,
    2*unit_depth + corridor_depth

]

curves = comps.OffsetCurve(guide_crv,offest_lengths, corners = 1)

#due to directionality the order of the list changes, therefore the if 
#condition

if bool_dir is False:
    
    outer_curves = [curves[0],curves[2]]
    outer_curves[1] = comps.FlipCurve(outer_curves[1])
    outer_curves[1] = outer_curves[1]['curve']
    
    inner_curves = [curves[1],curves[3]]
    inner_curves[1] = comps.FlipCurve(inner_curves[1])
    inner_curves[1] = inner_curves[1]['curve']

else:
    
    outer_curves = [curves[2],curves[3]]
    outer_curves[1] = comps.FlipCurve(outer_curves[1])
    outer_curves[1] = outer_curves[1]['curve']
    
    inner_curves = [curves[0],curves[1]]
    inner_curves[1] = comps.FlipCurve(inner_curves[1])
    inner_curves[1] = inner_curves[1]['curve']
# ---------- end python ----------

# ----
crv_2 = Curve(simplify(python.inner_curves))
crv_3 = Curve(simplify(python.outer_curves))
filter_2 = StreamFilter(Gate=true_single_loaded_false_double_loaded, Stream0=crv_2)
cluster = Cluster(curves=crv_3, unit_width=unit_width, curves_2=filter_2, unit_width_2=unit_width)  # -> F, F_2

merge = Merge(Data1=cluster.F, Data2=cluster.F_2)
python_2 = GhPythonScript(surfaces=merge)  # -> simplify(Typical_Units), Corner_Units, dic, areas, center_points, amount_of_units; inputs surfaces: list of Brep
# ---------- python_2: Python ----------
__author__ = "ilouh"
__version__ = "2023.02.21"

import rhinoscriptsyntax as rs
import Grasshopper as gh
import Rhino.Geometry as rg
import ghpythonlib.components as comps
import math

def UnitBoundary(srf):
    
    boundary = rs.DuplicateSurfaceBorder(srf)

    return boundary
    
Typical_Units = [] 
Corner_Units = []
areas = []
center_points = []

areas_Corner_units = []
areas_Typical_units = []

dic = {}

i = 0 

for surface in surfaces:
    
    
    temp = comps.DeconstructBrep(surface)
    points = temp['vertices']
    
    
    unit_area = comps.Area(surface)
    
    unit_center = unit_area['centroid']
    
    
    unit_area = round(unit_area['area'],2)
    unit_number = 'Unit Number {}'.format(i)
    
    
    if len(points) > 4: 
        
        unit_name = 'Corner Unit',
        unit_type = '2 BDRM',
        Corner_Units.append(surface)

        
    else:
        
        unit_name = 'Typical Unit',
        unit_type = '1 BDRM',
        Typical_Units.append(surface)


    dic_temp = {

        'Unit Name':  unit_name,
        'Unit Area': unit_area,
        'Unit Number' : unit_number,
        'Unit Type' : unit_type

    }
    
    dic[unit_number] = dic_temp
    str = '{} \n {} sf'.format(unit_type,unit_area)
    areas.append(str)
    center_points.append(unit_center)
    
    i= i+1

print(Typical_Units)

amount_of_units = len(surfaces)
# ---------- end python_2 ----------

python_3 = GhPythonScript(units=simplify(python_2.Typical_Units))  # -> out
# ---------- python_3: Python ----------
__author__ = "ilouh"
__version__ = "2023.02.21"

import rhinoscriptsyntax as rs
import Grasshopper as gh
import Rhino.Geometry as rg
import ghpythonlib.components as comps
import math

def UnitArea(srf):
    
    unit_area = comps.Area(srf)
    unit_center = unit_area['centroid']
    unit_area = unit_area['area']
    

    unit_area = round(unit_area)
    unit_area_str = str(unit_area) + ' SF'
    print(unit_area_str)
    return unit_area,unit_area_str,unit_center


def UnitBoundary(srf):
    
    boundary = rs.DuplicateSurfaceBorder(srf)
    
    return boundary

Bndy_curves = [] 

print(units)

if units != None: 

    boundary = UnitBoundary(units)
    out = boundary
# ---------- end python_3 ----------
python_4 = GhPythonScript(units=simplify(python_2.Corner_Units))  # -> out; same code as python_3
typical_corner_units = Curve(flatten(python_3))
corner_units = Curve(flatten(python_4))

tag = TextTag3D(Location=python_2.center_points, Text=python_2.areas, Size=Slider(2, range=0..100), Justification=5)
number_slider = Slider(41, range=0..100)

lng = ListLength()
series = Series(Start=0, Step=expr("x*1.1", number_slider), Count=lng)
Y = UnitY(Factor=series)
pt = Point(<point referenced from the Rhino model>)
move = Move(Geometry=pt, Motion=Y)  # -> Geometry, Transform

tag_2 = TextTag3D(Location=move.Geometry, Size=number_slider, Justification=7)
multiplication = Multiplication(B=Slider(5, range=0..15))

# ==== cluster Cluster
curves = ClusterInput()
curves_2 = ClusterInput()
unit_width = ClusterInput()
unit_width_2 = ClusterInput()

item = ListItem(Curves=curves, Index=0, Wrap=True)  # -> Item, Item1

# ---- group: curve subdivision per units dim
python = GhPythonScript(outer_curve=simplify(item.Item), unit_width=unit_width, inner_curve=simplify(item.Item1))  # -> simplify(outter_points), simplify(inner_points)
# ---------- python: Python ----------
__author__ = "ilouh"
__version__ = "2022.12.10"

import rhinoscriptsyntax as rs
import Grasshopper as gh
import Rhino.Geometry as rg
import ghpythonlib.components as comps
import math

def subdivide_curve(curve,unit_width):

    # Use the DivideCurve function to perform the subdivision
    points = comps.DivideDistance(curve,unit_width)
    points = comps.DivideCurve(curve,len(points['points']),kinks = True)
    
    return points['points']



#goal is to subdivide the curve into points appx per the width of a unit
outter_points = subdivide_curve(outer_curve,unit_width)

#find closest points
inner_points = comps.CurveClosestPoint(outter_points,inner_curve)
inner_points = inner_points['point']
# ---------- end python ----------

# ---- group: Get the X vector at each point
crv_cp = CurveClosestPoint(Point=python.outter_points, Curve=item.Item)  # -> Point, Parameter, Distance
hframe = HorizontalFrame(Curve=item.Item, Parameter=crv_cp.Parameter)
deplane = DeconstructPlane(Plane=hframe)  # -> Origin, XAxis, YAxis, ZAxis

# ---- group: creates a surface to be divided to units
python_2 = GhPythonScript(outer_curve=item.Item, inner_curve=item.Item1)  # -> srf; inputs outer_curve: Curve, inner_curve: Curve
# ---------- python_2: Python ----------
__author__ = "ilouh"
__version__ = "2023.02.21"

import rhinoscriptsyntax as rs
import Grasshopper as gh
import Rhino.Geometry as rg
import ghpythonlib.components as comps
import math


inner_curve = comps.FlipCurve(inner_curve,outer_curve)
inner_curve = inner_curve['curve']


if comps.Closed(outer_curve) is True: 
    srf = comps.BoundarySurfaces([outer_curve,inner_curve])

else:
    
    pts_outer = comps.EndPoints(outer_curve)
    pts_inner = comps.EndPoints(inner_curve)
    
    pts_outer_start = pts_outer['start']
    pts_outer_end = pts_outer['end']
    
    pts_inner_start = pts_inner['start']
    pts_inner_end = pts_inner['end']
    
    
    start_line = comps.Line(pts_outer_start,pts_inner_start)
    end_line = comps.Line(pts_outer_end,pts_inner_end)

    
    print(start_line)
    
    srf = comps.BoundarySurfaces([
        outer_curve,
        start_line,
        end_line,
        inner_curve])


    
    #srf = comps.BoundarySurfaces([outer_curve,inner_curve])

    #loft_option = comps.LoftOptions(True,True,0,0,0)
    #srf = comps.Loft([outer_curve,inner_curve],loft_option)
# ---------- end python_2 ----------

# ----
item_2 = ListItem(Curves=curves_2, Index=0, Wrap=True)  # -> Item, Item1

# ---- group: curve subdivision per units dim
python_3 = GhPythonScript(outer_curve=simplify(item_2.Item), unit_width=unit_width_2, inner_curve=simplify(item_2.Item1))  # -> simplify(outter_points), simplify(inner_points); same code as python

# ---- group: Get the X vector at each point
crv_cp_2 = CurveClosestPoint(Point=python_3.outter_points, Curve=item_2.Item)  # -> Point, Parameter, Distance
hframe_2 = HorizontalFrame(Curve=item_2.Item, Parameter=crv_cp_2.Parameter)
deplane_2 = DeconstructPlane(Plane=hframe_2)  # -> Origin, XAxis, YAxis, ZAxis

# ---- group: creates a surface to be divided to units
python_4 = GhPythonScript(outer_curve=item_2.Item, inner_curve=item_2.Item1)  # -> srf; inputs outer_curve: Curve, inner_curve: Curve; same code as python_2

# ----
pt = Point(python.outter_points)
pt_2 = Point(python.inner_points)

# ---- group: creates perpendicular dem walls
python_5 = GhPythonScript(outter_points=pt, inner_points=pt_2, vector1=deplane.XAxis)  # -> angled_walls, simplify(straight_walls); inputs outter_points: list of Point3d, inner_points: list of Point3d, vector1: list of Vector3d
# ---------- python_5: Python ----------
__author__ = "ilouh"
__version__ = "2023.02.21"

import rhinoscriptsyntax as rs
import Grasshopper as gh
import Rhino.Geometry as rg
import ghpythonlib.components as comps
import math



# Function to convert radians to degrees
def deg2rad(rad):
    return 180 / rad



P = []  # List to store points
straight_walls = [] 
angled_walls = []

# Loop through the points
for i in range(len(outter_points)):
    
    
    pt_start = outter_points[i] 
    pt_end = inner_points[i]

    crv = comps.Line(pt_start,pt_end)
    
    vector2 = comps.Vector2Pt(pt_start, pt_end, False)  # Calculate vector2
    
    dot_product = comps.Angle(vector1[i], vector2['vector'])  # Calculate dot product
    print(dot_product)

    
    if dot_product['angle'] is not None:
        dot_product_angle = math.degrees(dot_product['angle']) 
        
        if round(dot_product_angle) == float(90):
            straight_walls.append(crv)
            print(dot_product_angle)
            print('straight wall')
        # Convert angle to degrees
    else:
        dot_product_angle = 0
        

    # Check if the dot product angle is not 90 degrees
    if round(dot_product_angle) != float(90):
        pass
        angled_walls.append(crv)
        print('angled wall')
    else:
        P.append(outter_points[i])  # Add the point to the list

#print(len(P))

#print(vector1)
vector2 = vector2['vector']
# ---------- end python_5 ----------

# ----
crv = Curve(reparameterize(python_5.straight_walls))
srfsplit = SurfaceSplit(Surface=python_2, Curves=crv)

F = ClusterOutput(srfsplit)

pt_3 = Point(python_3.outter_points)
pt_4 = Point(python_3.inner_points)

# ---- group: creates perpendicular dem walls
python_6 = GhPythonScript(outter_points=pt_3, inner_points=pt_4, vector1=deplane_2.XAxis)  # -> angled_walls, simplify(straight_walls); inputs outter_points: list of Point3d, inner_points: list of Point3d, vector1: list of Vector3d; same code as python_5

# ----
crv_2 = Curve(reparameterize(python_6.straight_walls))
srfsplit_2 = SurfaceSplit(Surface=python_4, Curves=crv_2)

F_2 = ClusterOutput(srfsplit_2)
