# Grasshopper definition 22010 Importing.gh (Grasshopper 1.0.7)
# plug-ins: Rhino.Inside for Autodesk Revit, Pufferfish

brep = Brep([<brep referenced from the Rhino model> x2])
series = Series(Start=Slider(18, range=0..100), Step=0, Count=Slider(1, range=0..10))
series_2 = Series(Start=Slider(10, range=0..100), Step=0, Count=Slider(13, range=0..20))
model = ModelCategoriesPicker({"Abutments": -2006130, "Air Systems": -2001008, "Air Terminals": -2008013, "Analysis Display Style": -2000304, "Analysis Results": -2000303, "Areas": -2003200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}, selected="Spaces": -2003600)
model_2 = ModelCategoriesPicker({"Abutments": -2006130, "Air Systems": -2001008, "Air Terminals": -2008013, "Analysis Display Style": -2000304, "Analysis Results": -2000303, "Areas": -2003200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}, selected="Mass": -2003400)
model_3 = ModelCategoriesPicker({"Abutments": -2006130, "Air Systems": -2001008, "Air Terminals": -2008013, "Analysis Display Style": -2000304, "Analysis Results": -2000303, "Areas": -2003200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}, selected="Walls": -2000011)
bbox = BoundingBox(Content=brep, Plane=PlaneXY(0, 0, 0), UnionBox=True)  # -> Box, Box_2
merge = Merge(Data1=Slider(0, range=0..100), Data2=flatten(series), Data3=flatten(series_2))
contour = ContourEx(Shape=brep, Plane=PlaneXY(0, 0, 0), Distances=merge)  # -> flatten(Contours)
contour_2 = ContourEx(Shape=bbox.Box, Plane=PlaneXY(0, 0, 0), Distances=merge)  # -> flatten(Contours)
elementtype_byname = ElementTypeByName(
    model_3,
    {"Basic Wall : A1 - 8\" CONC. WALL": "74e40a3d-0714-4424-bc1b-3323c2789dda-4a491ba6-bbdf-4fe7-bf1c-26bb322f8e43-006ada96", "Basic Wall : A2 - 8\" CONC. GYP FINISH": "74e40a3d-0714-4424-bc1b-3323c2789dda-4a491ba6-bbdf-4fe7-bf1c-26bb322f8e43-006ada8d", "Basic Wall : A3 - 8\" CONC. BELOW GRADE": "74e40a3d-0714-4424-bc1b-3323c2789dda-4a491ba6-bbdf-4fe7-bf1c-26bb322f8e43-006adaa2", "Basic Wall : B1 - 8\" CMU": "74e40a3d-0714-4424-bc1b-3323c2789dda-4a491ba6-bbdf-4fe7-bf1c-26bb322f8e43-006ada8e", "Basic Wall : B2 - 8\" CMU W/ GWB": "74e40a3d-0714-4424-bc1b-3323c2789dda-4a491ba6-bbdf-4fe7-bf1c-26bb322f8e43-006ada8f", "Basic Wall : B3 - 8\" CMU W/ STUCCO": "74e40a3d-0714-4424-bc1b-3323c2789dda-4a491ba6-bbdf-4fe7-bf1c-26bb322f8e43-006ada97"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}, selected="Basic Wall : C1 - CEM. PLASTER 1HR EXT WALL": "74e40a3d-0714-4424-bc1b-3323c2789dda-4a491ba6-bbdf-4fe7-bf1c-26bb322f8e43-006ada93")
debrep = DeconstructBrep(Brep=brep)  # -> Faces, Edges, Vertices

area = Area(Geometry=contour_2)  # -> Area, Centroid
pdecon = Deconstruct(Point=area.Centroid)  # -> XComponent, YComponent, ZComponent
lng = ListLength(List=pdecon.ZComponent)

crv = Curve(contour)
_1_bed = Brep([<brep referenced from the Rhino model> x263])
_2_bed = Brep([<brep referenced from the Rhino model> x331])
cores = Brep([<brep referenced from the Rhino model> x76])
cores_2 = Brep(<brep referenced from the Rhino model>)
_2_bed_2 = Brep([<brep referenced from the Rhino model> x23])

md_slider = MDSlider(SliderMode=0, slider_value=Point(0.5, 0.5, 0.5), x_domain=Domain(0, 1), y_domain=Domain(0, 1), z_domain=Domain(0, 1))
evalsrf = EvaluateSurface(Surface=reparameterize(debrep.Faces), Point=md_slider)  # -> Point, Normal, UDirection, VDirection, Frame
devec = DeconstructVector(Vector=evalsrf.Normal)  # -> XComponent, YComponent, ZComponent
equals = Equality(FirstNumber=devec.ZComponent, SecondNumber=0)  # -> Equality, Inequality

type = Type(elementtype_byname)

explode = Explode(Curve=crv, Recursive=True)  # -> Segments, Vertices
reb = RebuildCurve(Curve=explode.Segments, Degree=1, Count=2, Tangents=True)
join = JoinCurves(Curves=reb, Preserve=False)  # -> flatten(Curves)

rebcrv = RebuildCurve(Curve=explode.Segments, Degree=1, EndTangents=False)
geodshape = AddGeometryDirectShape(Name="1.0 BD", Category=model_2, Geometry=_1_bed, TrackingMode=2)
geodshape_2 = AddGeometryDirectShape(Name="2.0 BD", Category=model_2, Geometry=_2_bed, TrackingMode=2)
geodshape_3 = AddGeometryDirectShape(Name="2.5 BD", Category=model_2, Geometry=_2_bed_2, TrackingMode=2)
geodshape_4 = AddGeometryDirectShape(Name="CORES", Category=model_2, Geometry=cores, TrackingMode=2)
geodshape_5 = AddGeometryDirectShape(Name="PUBLIC", Category=model_2, Geometry=cores_2, TrackingMode=2)

# ---- group: Name the Level
series_3 = Series(Start=0, Step=1, Count=lng)
level_name_python = GhPythonScript(y=series_3)  # -> a
# ---------- level_name_python: Python ----------
__author__ = "Brooks Scarpa"
__version__ = "2022.08.08"

import rhinoscriptsyntax as rs

a = "Floor {}".format(str(y))
# ---------- end level_name_python ----------

# ----
model_4 = ModelCategoriesPicker({"Abutments": -2006130, "Air Systems": -2001008, "Air Terminals": -2008013, "Analysis Display Style": -2000304, "Analysis Results": -2000303, "Areas": -2003200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}, selected="Areas")
floor = AddFloor(Boundary=graft(join), Type=<hostobjecttype referenced from the Revit model>, TrackingMode=2)
level = AddLevel(Elevation=pdecon.ZComponent, Name=level_name_python, TrackingMode=2)
cull = CullPattern(List=debrep.Faces, CullPattern=equals.Equality)

# ---- group: Grid Creation
edges = BrepEdges(Brep=cull)  # -> simplify(Naked), Interior, NonManifold
curvepoint = PointOnCurve(edges.Naked, parameter=0.5)
pdecon_2 = Deconstruct(Point=curvepoint)  # -> XComponent, YComponent, ZComponent
sort = SortList(Keys=pdecon_2.ZComponent, ValuesA=edges.Naked)  # -> Keys, ValuesA
item = ListItem(List=sort.ValuesA, Index=0, Wrap=True)
grid = AddGrid(Curve=item, TrackingMode=2)

# ----
elementtype_byname_2 = ElementTypeByName(model_4)

wires = BrepWireframe(Brep=cull, Density=-1)
join_2 = JoinCurves(Curves=wires, Preserve=False)
explode_2 = Explode(Curve=join_2, Recursive=True)  # -> Segments, Vertices
reb_2 = RebuildCurve(Curve=explode_2.Segments, Degree=1, Count=2, Tangents=True)
join_3 = JoinCurves(Curves=reb_2, Preserve=False)  # -> simplify(Curves)

wallprfl = AddWallProfile(Profile=join_3, Type=type, AllowJoins=Toggle(True), TrackingMode=2)
brep_2 = Brep([<brep referenced from the Rhino model> x35])
volume = Volume(Geometry=brep_2)  # -> Volume, Centroid
comploca = AddComponentLocation(Location=volume.Volume, Type=elementtype_byname_2, TrackingMode=2)
brep_3 = Brep([<brep referenced from the Rhino model> x5])
geodshape_6 = AddGeometryDirectShape(Category=<geometry referenced from the Revit model>, Geometry=brep_3, TrackingMode=2)

# ---- group: Topography
property_line = Curve(<curve referenced from the Rhino model>)

# ----
boundary = BoundarySurfaces(Edges=property_line)

# ---- group: Topography (continued)
topography = AddTopographyMesh(Mesh=boundary, TrackingMode=2)
