# Grasshopper definition Interoperable_RhinoToRevitCategories.gh (Grasshopper 1.0.7)
# plug-ins: Rhino.Inside for Autodesk Revit, Pufferfish

pipeline = GeometryPipeline(
    GroupByLayer=False,
    GroupByType=False,
    IncludeHidden=True,
    IncludeLocked=True,
    LayerFilter="01_ARCH_FLOORS",
    NameFilter="*",
    SublayerFiltering=True,
    TypeFilter=1073741848)
types = QueryTypes(Kind=3, Category=<geometry referenced from the Revit model>)

pipeline_2 = GeometryPipeline(
    GroupByLayer=False,
    GroupByType=False,
    IncludeHidden=True,
    IncludeLocked=True,
    LayerFilter="01_ARCH_ROOF",
    NameFilter="*",
    SublayerFiltering=True,
    TypeFilter=1073741848)
brep_top_boundary = BrepTopBoundary(B=pipeline_2)  # -> C, L

types_2 = QueryTypes(Kind=3, Category=<geometry referenced from the Revit model>)
pipeline_3 = GeometryPipeline(
    GroupByLayer=False,
    GroupByType=False,
    IncludeHidden=True,
    IncludeLocked=True,
    LayerFilter="01_ARCH_COLUMNS",
    NameFilter="*",
    SublayerFiltering=True,
    TypeFilter=1073741848)
types_3 = QueryTypes(Kind=3, Category=<geometry referenced from the Revit model>)
wall_type = Slider(1, range=0..10)
pipeline_4 = GeometryPipeline(
    GroupByLayer=False,
    GroupByType=False,
    IncludeHidden=True,
    IncludeLocked=True,
    LayerFilter="01_ARCH_GLAZING_GLASS",
    NameFilter="*",
    SublayerFiltering=True,
    TypeFilter=1073741848)
panel = Panel(types)
panel_2 = Panel(types_3)
panel_3 = Panel(types_2)
brep_top_boundary_2 = BrepTopBoundary(B=pipeline_3)  # -> C, L
brep_bottom_boundary = BrepBottomBoundary(B=pipeline_3)  # -> N, L
storefront = Brep(pipeline_4)
area = Area(Geometry=brep_top_boundary_2.L)  # -> Area, Centroid
area_2 = Area(Geometry=brep_bottom_boundary.L)  # -> Area, Centroid
edges = BrepEdges(Brep=storefront)  # -> Naked, Interior, NonManifold
ln = Line(StartPoint=area_2.Centroid, EndPoint=area.Centroid)
join = JoinCurves(Curves=edges.Naked, Preserve=False)
wallprfl = AddWallProfile(Profile=join, Type=<hostobjecttype referenced from the Revit model>, TrackingMode=2)
python = GhPythonScript(FloorPlates=pipeline)  # -> HighestFace; inputs FloorPlates: Brep
# ---------- python: Python ----------
__author__ = "ilouh"
__version__ = "2022.11.25"

import rhinoscriptsyntax as rs

import rhinoscriptsyntax as rs
import Grasshopper as gh
import Rhino.Geometry as rg
import ghpythonlib.components as comps

def listToTree(nestedList):
    
    """ Convert a nested python iterable to a datatree """
    
    dt = gh.DataTree[object]()
    for i,l in enumerate(nestedList):
        dt.AddRange(l,gh.Kernel.Data.GH_Path(i))
        
    return dt
    

brep_components = comps.DeconstructBrep(FloorPlates)
brep_components = brep_components['faces']

applicable_faces = []

def returnFaceCenterZValue(face):
    
    evaluation_point = comps.Area(face)
    z_point = evaluation_point['centroid']
    z_point = z_point[2]
    
    return z_point


z_values = []

for face in brep_components: 
    
    temp = returnFaceCenterZValue(face)
    z_values.append(temp)

dic = zip(brep_components,z_values)

HighestFace, HighestPoint = max(dic)
print(HighestPoint)
# ---------- end python ----------
brep_top_boundary_3 = BrepTopBoundary(B=pipeline)  # -> C, L
neg = Negative(Value=Slider(110, range=0..500))
item = ListItem(List=types_3, Index=Slider(4, range=0..10), Wrap=True)
neg_2 = Negative(Value=Slider(20, range=0..500))
floor_plate_boundary = Curve(brep_top_boundary_3.C)
dom = ConstructDomain(DomainStart=Slider(220, range=0..500), DomainEnd=neg_2)
dom_2 = ConstructDomain(DomainStart=Slider(20, range=0..500), DomainEnd=neg)
roof_boundary = Curve(brep_top_boundary.C)
item_2 = ListItem(List=types, Index=0, Wrap=True)
item_3 = ListItem(List=types_2, Index=3, Wrap=True)
dom² = ConstructDomain²(DomainU=dom_2, DomainV=dom)
roof = AddRoof(Boundary=roof_boundary, Type=item_3, TrackingMode=2)
floor = AddFloor(Boundary=floor_plate_boundary, Type=item_2, TrackingMode=2)
s_column = AddStructuralColumn(Curve=ln, Type=item, TrackingMode=2)
list = ValueList({"On": 0, "Off": 1}, selected="On")
get_geometry = GetGeometry(AtLeast=1, AtMost=1, DeleteInput=False, Filter=1074004029, TreeAccess=False)
pipeline_5 = GeometryPipeline(
    GroupByLayer=False,
    GroupByType=False,
    IncludeHidden=True,
    IncludeLocked=True,
    LayerFilter="SIGN",
    NameFilter="*",
    SublayerFiltering=True,
    TypeFilter=4)

# ---- group: Create Project Level
floors = Brep(pipeline)
roofs = Brep(pipeline_2)
merge = Merge(Data1=floors, Data2=roofs)  # -> flatten(Result)
area_3 = Area(Geometry=merge)  # -> Area, Centroid
bbox = BoundingBox(Content=merge, Plane=PlaneXY(0, 0, 0), UnionBox=True)  # -> Box, Box_2
pdecon = Deconstruct(Point=area_3.Centroid)  # -> XComponent, YComponent, ZComponent
expression = Expression(x=pdecon.ZComponent, Expression="round(x,2)")
cset = CreateSet(List=expression)  # -> Set, Map
sort = SortList(Keys=cset.Set)  # -> Keys, ValuesA

# ----
brep_top_boundary_4 = BrepTopBoundary(B=bbox.Box_2)  # -> C, L
srf = Surface(brep_top_boundary_4.L)
domain² = Domain²(srf)
lng = ListLength(List=sort.Keys)
python_2 = GhPythonScript(levels=sort.Keys)  # -> names; inputs levels: list
# ---------- python_2: Python ----------
__author__ = "ilouh"
__version__ = "2022.11.26"

import rhinoscriptsyntax as rs

names = []

for level in levels:
    idx = levels.index(level)
    temp = 'FLOOR PLAN {}'.format(idx)
    names.append(temp)
# ---------- end python_2 ----------
series = Series(Start=0, Step=1, Count=lng)
addition = Addition(A=300, B=series)

# ---- group: Create Project Level (continued)
level = AddLevel(Elevation=sort.Keys, Name=python_2, TrackingMode=2)

# ----
sheet = AddSheet(SheetNumber=addition, SheetName=python_2, TrackingMode=2)
floorplan = AddFloorPlan(Level=level, Name=python_2, TrackingMode=2)
extents = ViewExtents(View=floorplan, CropView=Toggle(True), CropRegionVisible=Toggle(True), CropExtents=dom²)  # -> View, CropView, CropRegionVisible, CropExtents
viewport = AddViewport(Sheet=sheet, View=floorplan, TrackingMode=2)
title_block = AddTitleBlock(Sheet=sheet, Type=<familysymbol referenced from the Revit model>, TrackingMode=2)
identity = ViewIdentity(View=extents.View)  # -> Discipline, ViewFamily, ViewName, IsDependent, IsTemplate, IsAssembly, IsPrintable

# ---- group: 2nd Floor
levels = LevelsPicker(<levels picker referenced from the Revit model>)  # disabled
_2nd_floor_plate = Brep([<brep referenced from the Rhino model> x2])  # disabled
identity_2 = LevelIdentity(Level=levels)  # -> Name, Elevation, Structural, BuildingStory; disabled
pt = ConstructPoint(XCoordinate=0, YCoordinate=0, ZCoordinate=identity_2.Elevation)  # disabled
xy = XYPlane(Origin=pt)  # disabled
movetoplane = MoveToPlane(Plane=xy, Above=True, Below=True)  # -> Geometry, Transform; disabled

# ----
gate = StreamGate(Stream=_2nd_floor_plate, Gate=list)  # -> Target0, Target1; disabled
simplify = SimplifyCurve(Curve=movetoplane.Geometry)  # -> simplify(Curve), Simplified; disabled

# ---- group: 2nd Floor (continued)
brep_top_boundary_5 = BrepTopBoundary(B=gate.Target0)  # -> C, L; disabled
floor_2 = AddFloor(Boundary=simplify.Curve, Type=<hostobjecttype referenced from the Revit model>, Level=levels, TrackingMode=2)  # disabled

# ---- group: 3rd Floor
levels_2 = LevelsPicker(<levels picker referenced from the Revit model>)  # disabled
_3rd_floor_plate = Brep([<brep referenced from the Rhino model> x2])  # disabled
identity_3 = LevelIdentity(Level=levels_2)  # -> Name, Elevation, Structural, BuildingStory; disabled
pt_2 = ConstructPoint(XCoordinate=0, YCoordinate=0, ZCoordinate=identity_3.Elevation)  # disabled
xy_2 = XYPlane(Origin=pt_2)  # disabled
movetoplane_2 = MoveToPlane(Plane=xy_2, Above=True, Below=True)  # -> Geometry, Transform; disabled

# ----
gate_2 = StreamGate(Stream=_3rd_floor_plate, Gate=list)  # -> Target0, Target1; disabled
simplify_2 = SimplifyCurve(Curve=movetoplane_2.Geometry)  # -> simplify(Curve), Simplified; disabled

# ---- group: 3rd Floor (continued)
brep_top_boundary_6 = BrepTopBoundary(B=gate_2.Target0)  # -> C, L; disabled
floor_3 = AddFloor(Boundary=simplify_2.Curve, Type=<hostobjecttype referenced from the Revit model>, Level=levels_2, TrackingMode=2)  # disabled

# ---- group: Roof
levels_3 = LevelsPicker(<levels picker referenced from the Revit model>)  # disabled
roof_type = Slider(3, range=0..10)  # disabled
roof_outline = Brep([<brep referenced from the Rhino model> x2])  # disabled
identity_4 = LevelIdentity(Level=levels_3)  # -> Name, Elevation, Structural, BuildingStory; disabled
pt_3 = ConstructPoint(XCoordinate=0, YCoordinate=0, ZCoordinate=identity_4.Elevation)  # disabled
xy_3 = XYPlane(Origin=pt_3)  # disabled
movetoplane_3 = MoveToPlane(Plane=xy_3, Above=True, Below=True)  # -> Geometry, Transform; disabled
roof_2 = AddRoof(Boundary=movetoplane_3.Geometry, Type=<hostobjecttype referenced from the Revit model>, Level=levels_3, TrackingMode=2)  # disabled

# ----
gate_3 = StreamGate(Stream=roof_outline, Gate=list)  # -> Target0, Target1; disabled

# ---- group: Roof (continued)
brep_top_boundary_7 = BrepTopBoundary(B=gate_3.Target0)  # -> C, L; disabled

# ---- group: Stairs
categories = DirectShapeCategories("autodesk.revit.category.local:stairs-1.0.0", SearchPattern="stairs")  # disabled
stair = Brep(graft([<brep referenced from the Rhino model> x128]))  # disabled
panel_4 = Panel("Stair")  # disabled

# ----
gate_4 = StreamGate(Stream=stair, Gate=list)  # -> Target0, Target1; disabled

# ---- group: Stairs (continued)
geodshape = AddGeometryDirectShape(Name=panel_4, Category=categories, Geometry=gate_4.Target0, TrackingMode=2)  # disabled

# ---- group: 1st Floor
categories_2 = DirectShapeCategories("autodesk.revit.category.local:floors-1.0.0", SearchPattern="Floors")  # disabled
_1st_floor = Brep(graft([<brep referenced from the Rhino model> x15]))  # disabled
panel_5 = Panel("1st Floor")  # disabled

# ----
gate_5 = StreamGate(Stream=_1st_floor, Gate=list)  # -> Target0, Target1; disabled

# ---- group: 1st Floor (continued)
geodshape_2 = AddGeometryDirectShape(Name=panel_5, Category=categories_2, Geometry=gate_5.Target0, TrackingMode=2)  # disabled

# ---- group: Railing
categories_3 = DirectShapeCategories("autodesk.revit.category.family:stairsRailing-1.0.0", SearchPattern="Rails")  # disabled
railing = Brep(graft([<brep referenced from the Rhino model> x8]))  # disabled
panel_6 = Panel("Slanted Roof")  # disabled

# ----
gate_6 = StreamGate(Stream=railing, Gate=list)  # -> Target0, Target1; disabled

# ---- group: Railing (continued)
geodshape_3 = AddGeometryDirectShape(Name=panel_6, Category=categories_3, Geometry=gate_6.Target0, TrackingMode=2)  # disabled

# ---- group: Generic Models
categories_4 = DirectShapeCategories("autodesk.revit.category.family:genericModel-1.0.0", SearchPattern="Generic")  # disabled
fins = Brep(graft([<brep referenced from the Rhino model> x5]))  # disabled
panel_7 = Panel("Slanted Roof")  # disabled

# ----
gate_7 = StreamGate(Stream=fins, Gate=list)  # -> Target0, Target1; disabled

# ---- group: Generic Models (continued)
geodshape_4 = AddGeometryDirectShape(Name=panel_7, Category=categories_4, Geometry=gate_7.Target0, TrackingMode=2)  # disabled

# ---- group: Custom Roofs
categories_5 = DirectShapeCategories("autodesk.revit.category.local:roofs-1.0.0", SearchPattern="Roof")  # disabled
roofs_2 = Brep(graft([<brep referenced from the Rhino model> x22]))  # disabled
panel_8 = Panel("Slanted Roof")  # disabled

# ----
gate_8 = StreamGate(Stream=roofs_2, Gate=list)  # -> Target0, Target1; disabled

# ---- group: Custom Roofs (continued)
geodshape_5 = AddGeometryDirectShape(Name=panel_8, Category=categories_5, Geometry=gate_8.Target0, TrackingMode=2)  # disabled

# ---- group: Mass
categories_6 = DirectShapeCategories("autodesk.revit.category.family:mass-1.0.0", SearchPattern="Mass")  # disabled
mass = Brep(graft([<brep referenced from the Rhino model> x2]))  # disabled
panel_9 = Panel("Slanted Roof")  # disabled

# ----
gate_9 = StreamGate(Stream=mass, Gate=list)  # -> Target0, Target1; disabled

# ---- group: Mass (continued)
geodshape_6 = AddGeometryDirectShape(Name=panel_9, Category=categories_6, Geometry=gate_9.Target0, TrackingMode=2)  # disabled

# ---- group: Exterior Walls - Brick
panel_10 = Panel("/")  # disabled
wall_type_2 = Slider(30, range=0..30)  # disabled
walls = Brep([<brep referenced from the Rhino model> x33])  # disabled
md_slider = MDSlider(SliderMode=0, slider_value=Point(0.5, 0.5, 0.5), x_domain=Domain(0, 1), y_domain=Domain(0, 1), z_domain=Domain(0, 1))  # disabled
slider = Slider(3, range=1..100)  # disabled

# ----
gate_10 = StreamGate(Stream=walls, Gate=list)  # -> Target0, Target1; disabled

# ---- group: Exterior Walls - Brick
debrep = DeconstructBrep(Brep=gate_10.Target0)  # -> Faces, Edges, Vertices; disabled
area_4 = Area(Geometry=debrep.Faces)  # -> Area, Centroid; disabled
sort_2 = SortList(Keys=area_4.Area, ValuesA=debrep.Faces)  # -> Keys, ValuesA; disabled
rev = ReverseList(List=sort_2.ValuesA)  # disabled
item_4 = ListItem(List=rev, Index=0, Wrap=True)  # disabled

md_slider_2 = MDSlider(SliderMode=0, slider_value=Point(0.5, 0.5, 0.5), x_domain=Domain(0, 1), y_domain=Domain(0, 1), z_domain=Domain(0, 1))  # disabled
curvature = SurfaceCurvature(Surface=reparameterize(item_4), Point=md_slider_2)  # -> Frame, Gaussian, Mean; disabled
expression_2 = Expression(x=curvature.Mean, Expression="abs(round(x,4))")  # disabled
python_3 = GhPythonScript(x=expression_2, srf=item_4)  # -> flatten(c_srf), flatten(s_srf); disabled
# ---------- python_3: Python ----------
__author__ = "ilouh"
__version__ = "2022.05.14"

import rhinoscriptsyntax as rs

if x != 0: 
    c_srf = srf
else: 
    s_srf = srf
# ---------- end python_3 ----------

# ---- group: CurtainWalls
storefront_2 = Brep([<brep referenced from the Rhino model> x27])  # disabled
wall_type_3 = Slider(31, range=0..31)  # disabled

# ----
gate_11 = StreamGate(Stream=storefront_2, Gate=list)  # -> Target0, Target1; disabled

# ---- group: CurtainWalls (continued)
srf_2 = Surface(gate_11.Target0)  # disabled

md_slider_3 = MDSlider(SliderMode=0, slider_value=Point(0.5, 0.5, 0.5), x_domain=Domain(0, 1), y_domain=Domain(0, 1), z_domain=Domain(0, 1))  # disabled
curvature_2 = SurfaceCurvature(Surface=reparameterize(srf_2), Point=md_slider_3)  # -> Frame, Gaussian, Mean; disabled
expression_3 = Expression(x=curvature_2.Mean, Expression="abs(round(x,4))")  # disabled
python_4 = GhPythonScript(x=expression_3, srf=srf_2)  # -> flatten(c_srf), flatten(s_srf); disabled; same code as python_3
clean = CleanTree(RemoveNulls=True, RemoveInvalid=True, RemoveEmpty=False, Tree=python_4.c_srf)  # disabled
clean_2 = CleanTree(RemoveNulls=True, RemoveInvalid=True, RemoveEmpty=False, Tree=python_4.s_srf)  # disabled

python_5 = GhPythonScript(srf=clean_2)  # -> out; disabled
# ---------- python_5: Python ----------
__author__ = "ilouh"
__version__ = "2022.05.14"

import rhinoscriptsyntax as rs

test = rs.ShrinkTrimmedSurface(srf,True)


if test is not None: 

    out = test 
    
else: 

    out = srf
# ---------- end python_5 ----------
walls_by_profile = Brep(graft(python_5))  # disabled

explode = Explode(Curve=clean, Recursive=True)  # -> Segments, Vertices; disabled
curvepoint = PointOnCurve(explode.Segments, parameter=0.5)  # disabled
pdecon_2 = Deconstruct(Point=curvepoint)  # -> XComponent, YComponent, ZComponent; disabled
sort_3 = SortList(Keys=pdecon_2.ZComponent, ValuesA=explode.Segments)  # -> Keys, ValuesA; disabled
item_5 = ListItem(List=sort_3.Keys, Index=0, Wrap=True)  # -> Item1, Item; disabled
item_6 = ListItem(List=sort_3.ValuesA, Index=0, Wrap=True)  # disabled
subtraction = Subtraction(A=item_5.Item1, B=item_5.Item)  # disabled
end = EndPoints(Curve=item_6)  # -> Start, End; disabled
curvepoint_2 = PointOnCurve(item_6, parameter=0.5)  # disabled
expression_4 = Expression(x=subtraction, Expression="round(x,2)")  # disabled
arc = Arc3Pt(PointA=end.Start, PointB=curvepoint_2, PointC=end.End)  # -> Arc, Plane, Radius; disabled
height = Number(expression_4)  # disabled
wall_by_curve = Curve(arc.Arc)  # disabled

md_slider_4 = MDSlider(SliderMode=0, slider_value=Point(0.5, 0.5, 0.5), x_domain=Domain(0, 1), y_domain=Domain(0, 1), z_domain=Domain(0, 1))  # disabled
evalsrf = EvaluateSurface(Surface=reparameterize(walls_by_profile), Point=md_slider_4)  # -> Point, Normal, UDirection, VDirection, Frame; disabled
project = Project(Geometry=walls_by_profile, Plane=evalsrf.Frame)  # -> Geometry, Transform; disabled

number_slider = Slider(0, range=-10..10)  # disabled
amp = Amplitude(Vector=evalsrf.Normal, Amplitude=expr("x/12", number_slider))  # disabled
move = Move(Geometry=project.Geometry, Motion=amp)  # -> Geometry, Transform; disabled
edges_2 = BrepEdges(Brep=move.Geometry)  # -> Naked, Interior, NonManifold; disabled
join_2 = JoinCurves(Curves=edges_2.Naked, Preserve=False)  # -> simplify(Curves); disabled
wll = WallLocationLine({"Wall Centerline": 0, "Core Centerline": 1, "Finish (Exterior Face)": 2, "Finish (Interior Face)": 3, "Core (Exterior Face)": 4, "Core (Interior Face)": 5}, selected="Core Centerline")  # disabled

len = Length(Curve=wall_by_curve)  # disabled
larger = LargerThan(FirstNumber=len, SecondNumber=1)  # -> LargerThan, OrEqualTo; disabled
cull = CullPattern(List=wall_by_curve, CullPattern=larger.LargerThan)  # disabled

# ----
simplify_3 = SimplifyCurve(Curve=join_2)  # -> simplify(Curve), Simplified; disabled
simplify_4 = SimplifyCurve(Curve=height)  # -> simplify(Curve), Simplified; disabled

# ---- group: CurtainWalls (continued)
wallcrv = AddWallCurve(
    Curve=simplify_4.Curve,
    Type=<hostobjecttype referenced from the Revit model>,
    Height=height,
    LocationLine=wll,
    TrackingMode=2)  # disabled
wallprfl_2 = AddWallProfile(Type=<hostobjecttype referenced from the Revit model>, LocationLine=wll, TrackingMode=2)  # disabled

# ---- group: Exterior Walls - Brick (continued)
panel_13 = Panel(curvature.Mean)  # disabled
python_6 = GhPythonScript(x=expression_2, srf=item_4)  # -> flatten(out); disabled
# ---------- python_6: Python ----------
__author__ = "ilouh"
__version__ = "2022.05.14"

import rhinoscriptsyntax as rs

if x != 0: 
    out = True
else: 
    out = False
# ---------- end python_6 ----------
not = GateNot(A=python_6)  # disabled
straight_walls = CullPattern(List=gate_10.Target0, CullPattern=not)  # disabled
get_largest_faces = GetLargestFaces(B=straight_walls)  # -> i, item_1; disabled
srf_3 = Surface(get_largest_faces.item_1)  # disabled
srf_4 = Surface(get_largest_faces.i)  # disabled
twn2srfs = TweenTwoSurfaces(SurfaceA=srf_4, SurfaceB=srf_3, Factor=0.5, Refit=0, PointSample=0)  # disabled
curved_wall = CullPattern(List=gate_10.Target0, CullPattern=python_6)  # disabled
getbottomface = GetBottomFace(B=curved_wall)  # disabled
bottom_face = Surface(flatten(getbottomface))  # disabled
get_longest_edge_curves = GetLongestEdgeCurves(B=bottom_face)  # -> i, item_1; disabled
getwallheight = GetWallHeight(C=curved_wall)  # disabled
crv = Curve(get_longest_edge_curves.i)  # disabled
crv_2 = Curve(get_longest_edge_curves.item_1)  # disabled
disc = Discontinuity(Curve=crv_2, Level=1)  # -> Points, Parameters; disabled
height_2 = Number(getwallheight)  # disabled
convert2arc = Convert2Arc(C=crv)  # disabled
convert2arc_2 = Convert2Arc(C=crv_2)  # disabled
rebuildmidarc = RebuildMidArc(C=convert2arc, C_2=convert2arc_2)  # -> i, item_1, item_2; disabled
arc_2 = Arc3Pt(PointA=rebuildmidarc.i, PointB=rebuildmidarc.item_1, PointC=rebuildmidarc.item_2)  # -> Arc, Plane, Radius; disabled

# ----
tweensurface = TweenSurface(G=srf_4, G_2=srf_3)  # disabled
srf_5 = Surface(tweensurface)  # disabled

# ---- group: Exterior Walls - Brick
python_7 = GhPythonScript(srf=srf_5)  # -> out; disabled
# ---------- python_7: Python ----------
__author__ = "ilouh"
__version__ = "2022.05.14"

import rhinoscriptsyntax as rs

test = rs.ShrinkTrimmedSurface(srf,True)

if test is not None: 

    out = test 

else: 

    out = srf
print(out)
# ---------- end python_7 ----------
walls_by_profile_2 = Brep(graft(python_7))  # disabled

edges_3 = BrepEdges(Brep=walls_by_profile_2)  # -> simplify(Naked), Interior, NonManifold; disabled
join_3 = JoinCurves(Curves=edges_3.Naked, Preserve=False)  # disabled
wll_2 = WallLocationLine({"Wall Centerline": 0, "Core Centerline": 1, "Finish (Exterior Face)": 2, "Finish (Interior Face)": 3, "Core (Exterior Face)": 4, "Core (Interior Face)": 5}, selected="Core Centerline")  # disabled

# ----
simplify_5 = SimplifyCurve(Curve=arc_2.Arc)  # -> simplify(Curve), Simplified; disabled

# ---- group: Exterior Walls - Brick (continued)
evalsrf_2 = EvaluateSurface(Surface=walls_by_profile_2, Point=md_slider)  # -> Point, Normal, UDirection, VDirection, Frame; disabled
project_2 = Project(Geometry=join_3, Plane=evalsrf_2.Frame)  # -> Geometry, Transform; disabled
wallcrv_2 = AddWallCurve(
    Curve=simplify_5.Curve,
    Type=<hostobjecttype referenced from the Revit model>,
    Height=graft(height_2),
    LocationLine=wll_2,
    TrackingMode=2)  # disabled
wallprfl_3 = AddWallProfile(Type=<hostobjecttype referenced from the Revit model>, LocationLine=wll_2, TrackingMode=2)  # disabled

# ----
simplify_6 = SimplifyCurve(Curve=project_2.Geometry)  # -> simplify(Curve), Simplified; disabled

# ---- group: Exterior Concrete Walls
exterior_concrete_walls = Brep([<brep referenced from the Rhino model> x31])  # disabled
gate_12 = StreamGate(Stream=exterior_concrete_walls, Gate=list)  # -> Target0, Target1; disabled
getbottomface_2 = GetBottomFace(B=gate_12.Target0)  # disabled
bottom_face_2 = Surface(flatten(getbottomface_2))  # disabled
get_longest_edge_curves_2 = GetLongestEdgeCurves(B=bottom_face_2)  # -> i, item_1; disabled
getwallheight_2 = GetWallHeight(C=gate_12.Target0)  # disabled
crv_3 = Curve(flatten(get_longest_edge_curves_2.item_1))  # disabled
crv_4 = Curve(flatten(get_longest_edge_curves_2.i))  # disabled
height_3 = Number(getwallheight_2)  # disabled
wll_3 = WallLocationLine({"Wall Centerline": 0, "Core Centerline": 1, "Finish (Exterior Face)": 2, "Finish (Interior Face)": 3, "Core (Exterior Face)": 4, "Core (Interior Face)": 5}, selected="Core Centerline")  # disabled
toggle = BooleanToggle(False)  # disabled

# ---- group: Exterior Concrete Walls / Evaluate Arc/Line
len_2 = Length(Curve=crv_4)  # disabled
end_2 = EndPoints(Curve=crv_4)  # -> Start, End; disabled
dist = Distance(PointA=end_2.Start, PointB=end_2.End)  # disabled
smaller = SmallerThan(FirstNumber=expr("round(x,2)", dist), SecondNumber=expr("round(x,2)", len_2))  # -> SmallerThan, OrEqualTo; disabled

# ---- group: Exterior Concrete Walls
cull_2 = CullPattern(List=crv_4, CullPattern=smaller.SmallerThan)  # disabled
cull_3 = CullPattern(List=crv_3, CullPattern=smaller.SmallerThan)  # disabled
arc_3 = Curve(graft(cull_2))  # disabled
arc_4 = Curve(graft(cull_3))  # disabled
eval = EvaluateCurve(Curve=reparameterize(arc_3), Parameter=[0, 0.5, 1])  # -> Point, Tangent, Angle; disabled
crv_cp = CurveClosestPoint(Point=eval.Point, Curve=arc_4)  # -> Point, Parameter, Distance; disabled
ln_2 = Line(StartPoint=eval.Point, EndPoint=crv_cp.Point)  # disabled
midpt = CurveMiddle(Curve=ln_2)  # disabled
item_7 = ListItem(List=simplify(midpt), Index=0, Wrap=True)  # -> Item, Item1, Item2; disabled

# ---- group: Interior Walls
interior_walls = Brep([<brep referenced from the Rhino model> x38])  # disabled
gate_13 = StreamGate(Stream=interior_walls, Gate=list)  # -> Target0, Target1; disabled
getbottomface_3 = GetBottomFace(B=gate_13.Target0)  # disabled
bottom_face_3 = Surface(flatten(getbottomface_3))  # disabled
get_longest_edge_curves_3 = GetLongestEdgeCurves(B=bottom_face_3)  # -> i, item_1; disabled
getwallheight_3 = GetWallHeight(C=gate_13.Target0)  # disabled
crv_5 = Curve(flatten(get_longest_edge_curves_3.item_1))  # disabled
crv_6 = Curve(flatten(get_longest_edge_curves_3.i))  # disabled
height_4 = Number(getwallheight_3)  # disabled
wll_4 = WallLocationLine({"Wall Centerline": 0, "Core Centerline": 1, "Finish (Exterior Face)": 2, "Finish (Interior Face)": 3, "Core (Exterior Face)": 4, "Core (Interior Face)": 5}, selected="Core Centerline")  # disabled
toggle_2 = BooleanToggle(False)  # disabled

# ---- group: Interior Walls / Evaluate Arc/Line
len_3 = Length(Curve=crv_6)  # disabled
end_3 = EndPoints(Curve=crv_6)  # -> Start, End; disabled
dist_2 = Distance(PointA=end_3.Start, PointB=end_3.End)  # disabled
smaller_2 = SmallerThan(FirstNumber=expr("round(x,2)", dist_2), SecondNumber=expr("round(x,2)", len_3))  # -> SmallerThan, OrEqualTo; disabled

# ---- group: Interior Walls
cull_4 = CullPattern(List=crv_6, CullPattern=smaller_2.SmallerThan)  # disabled
cull_5 = CullPattern(List=crv_5, CullPattern=smaller_2.SmallerThan)  # disabled
arc_5 = Curve(graft(cull_4))  # disabled
arc_6 = Curve(graft(cull_5))  # disabled
eval_2 = EvaluateCurve(Curve=reparameterize(arc_5), Parameter=[0, 0.5, 1])  # -> Point, Tangent, Angle; disabled
crv_cp_2 = CurveClosestPoint(Point=eval_2.Point, Curve=arc_6)  # -> Point, Parameter, Distance; disabled
ln_3 = Line(StartPoint=eval_2.Point, EndPoint=crv_cp_2.Point)  # disabled
midpt_2 = CurveMiddle(Curve=ln_3)  # disabled
item_8 = ListItem(List=simplify(midpt_2), Index=0, Wrap=True)  # -> Item, Item1, Item2; disabled

# ---- group: Parapets
parapets = Brep([<brep referenced from the Rhino model> x14])  # disabled
gate_14 = StreamGate(Stream=parapets, Gate=list)  # -> Target0, Target1; disabled
getbottomface_4 = GetBottomFace(B=gate_14.Target0)  # disabled
bottom_face_4 = Surface(flatten(getbottomface_4))  # disabled
get_longest_edge_curves_4 = GetLongestEdgeCurves(B=bottom_face_4)  # -> i, item_1; disabled
getwallheight_4 = GetWallHeight(C=gate_14.Target0)  # disabled
crv_7 = Curve(flatten(get_longest_edge_curves_4.item_1))  # disabled
crv_8 = Curve(flatten(get_longest_edge_curves_4.i))  # disabled
height_5 = Number(getwallheight_4)  # disabled
wll_5 = WallLocationLine({"Wall Centerline": 0, "Core Centerline": 1, "Finish (Exterior Face)": 2, "Finish (Interior Face)": 3, "Core (Exterior Face)": 4, "Core (Interior Face)": 5}, selected="Core Centerline")  # disabled
toggle_3 = BooleanToggle(False)  # disabled

# ---- group: Parapets / Evaluate Arc/Line
len_4 = Length(Curve=crv_8)  # disabled
end_4 = EndPoints(Curve=crv_8)  # -> Start, End; disabled
dist_3 = Distance(PointA=end_4.Start, PointB=end_4.End)  # disabled
smaller_3 = SmallerThan(FirstNumber=expr("round(x,2)", dist_3), SecondNumber=expr("round(x,2)", len_4))  # -> SmallerThan, OrEqualTo; disabled

# ---- group: Parapets
cull_6 = CullPattern(List=crv_8, CullPattern=smaller_3.SmallerThan)  # disabled
cull_7 = CullPattern(List=crv_7, CullPattern=smaller_3.SmallerThan)  # disabled
arc_7 = Curve(graft(cull_6))  # disabled
arc_8 = Curve(graft(cull_7))  # disabled
eval_3 = EvaluateCurve(Curve=reparameterize(arc_7), Parameter=[0, 0.5, 1])  # -> Point, Tangent, Angle; disabled
crv_cp_3 = CurveClosestPoint(Point=eval_3.Point, Curve=arc_8)  # -> Point, Parameter, Distance; disabled
ln_4 = Line(StartPoint=eval_3.Point, EndPoint=crv_cp_3.Point)  # disabled
midpt_3 = CurveMiddle(Curve=ln_4)  # disabled
item_9 = ListItem(List=simplify(midpt_3), Index=0, Wrap=True)  # -> Item, Item1, Item2; disabled

# ---- group: Interior Walls (continued)
not_2 = GateNot(A=smaller_2.SmallerThan)  # disabled
arc_9 = Arc3Pt(PointA=item_8.Item, PointB=item_8.Item1, PointC=item_8.Item2)  # -> Arc, Plane, Radius; disabled

cull_8 = CullPattern(List=crv_6, CullPattern=not_2)  # disabled
cull_9 = CullPattern(List=crv_5, CullPattern=not_2)  # disabled
line = Curve(graft(cull_8))  # disabled
line_2 = Curve(graft(cull_9))  # disabled
eval_4 = EvaluateCurve(Curve=reparameterize(line), Parameter=[0, 1])  # -> Point, Tangent, Angle; disabled
crv_cp_4 = CurveClosestPoint(Point=eval_4.Point, Curve=line_2)  # -> Point, Parameter, Distance; disabled
ln_5 = Line(StartPoint=eval_4.Point, EndPoint=crv_cp_4.Point)  # disabled
midpt_4 = CurveMiddle(Curve=ln_5)  # disabled
item_10 = ListItem(List=simplify(midpt_4), Index=0, Wrap=True)  # -> Item, Item1; disabled

cull_10 = CullPattern(List=height_4, CullPattern=not_2)  # disabled
cull_11 = CullPattern(List=height_4, CullPattern=smaller_2.SmallerThan)  # disabled
arc_10 = Number(flatten(cull_11))  # disabled
line_3 = Number(flatten(cull_10))  # disabled
merge_2 = Merge(Data1=arc_10, Data2=line_3)  # -> graft(Result); disabled

# ---- group: Parapets (continued)
not_3 = GateNot(A=smaller_3.SmallerThan)  # disabled
arc_11 = Arc3Pt(PointA=item_9.Item, PointB=item_9.Item1, PointC=item_9.Item2)  # -> Arc, Plane, Radius; disabled

cull_12 = CullPattern(List=crv_8, CullPattern=not_3)  # disabled
cull_13 = CullPattern(List=crv_7, CullPattern=not_3)  # disabled
line_4 = Curve(graft(cull_12))  # disabled
line_5 = Curve(graft(cull_13))  # disabled
eval_5 = EvaluateCurve(Curve=reparameterize(line_4), Parameter=[0, 1])  # -> Point, Tangent, Angle; disabled
crv_cp_5 = CurveClosestPoint(Point=eval_5.Point, Curve=line_5)  # -> Point, Parameter, Distance; disabled
ln_6 = Line(StartPoint=eval_5.Point, EndPoint=crv_cp_5.Point)  # disabled
midpt_5 = CurveMiddle(Curve=ln_6)  # disabled
item_11 = ListItem(List=simplify(midpt_5), Index=0, Wrap=True)  # -> Item, Item1; disabled

cull_14 = CullPattern(List=height_5, CullPattern=not_3)  # disabled
cull_15 = CullPattern(List=height_5, CullPattern=smaller_3.SmallerThan)  # disabled
arc_12 = Number(flatten(cull_15))  # disabled
line_6 = Number(flatten(cull_14))  # disabled
merge_3 = Merge(Data1=arc_12, Data2=line_6)  # -> graft(Result); disabled

# ---- group: Exterior Concrete Walls (continued)
not_4 = GateNot(A=smaller.SmallerThan)  # disabled
arc_13 = Arc3Pt(PointA=item_7.Item, PointB=item_7.Item1, PointC=item_7.Item2)  # -> Arc, Plane, Radius; disabled

cull_16 = CullPattern(List=crv_4, CullPattern=not_4)  # disabled
cull_17 = CullPattern(List=crv_3, CullPattern=not_4)  # disabled
line_7 = Curve(graft(cull_16))  # disabled
line_8 = Curve(graft(cull_17))  # disabled
eval_6 = EvaluateCurve(Curve=reparameterize(line_7), Parameter=[0, 1])  # -> Point, Tangent, Angle; disabled
crv_cp_6 = CurveClosestPoint(Point=eval_6.Point, Curve=line_8)  # -> Point, Parameter, Distance; disabled
ln_7 = Line(StartPoint=eval_6.Point, EndPoint=crv_cp_6.Point)  # disabled
midpt_6 = CurveMiddle(Curve=ln_7)  # disabled
item_12 = ListItem(List=simplify(midpt_6), Index=0, Wrap=True)  # -> Item, Item1; disabled

cull_18 = CullPattern(List=height_3, CullPattern=not_4)  # disabled
cull_19 = CullPattern(List=height_3, CullPattern=smaller.SmallerThan)  # disabled
arc_14 = Number(flatten(cull_19))  # disabled
line_9 = Number(flatten(cull_18))  # disabled
merge_4 = Merge(Data1=arc_14, Data2=line_9)  # -> graft(Result); disabled

# ---- group: Interior Walls (continued)
ln_8 = Line(StartPoint=item_10.Item, EndPoint=item_10.Item1)  # disabled
merge_5 = Merge(Data1=flatten(arc_9.Arc), Data2=flatten(ln_8))  # -> graft(Result); disabled

# ----
simplify_7 = SimplifyCurve(Curve=merge_5)  # -> simplify(Curve), Simplified; disabled

# ---- group: Interior Walls (continued)
wallcrv_3 = AddWallCurve(
    Curve=simplify_7.Curve,
    Type=<hostobjecttype referenced from the Revit model>,
    Height=graft(merge_2),
    LocationLine=wll_4,
    AllowJoins=toggle_2,
    TrackingMode=2)  # disabled

# ---- group: Parapets (continued)
ln_9 = Line(StartPoint=item_11.Item, EndPoint=item_11.Item1)  # disabled
merge_6 = Merge(Data1=flatten(arc_11.Arc), Data2=flatten(ln_9))  # -> graft(Result); disabled

# ----
simplify_8 = SimplifyCurve(Curve=merge_6)  # -> simplify(Curve), Simplified; disabled

# ---- group: Parapets (continued)
wallcrv_4 = AddWallCurve(
    Curve=simplify_8.Curve,
    Type=<hostobjecttype referenced from the Revit model>,
    Height=graft(merge_3),
    LocationLine=wll_5,
    AllowJoins=toggle_3,
    TrackingMode=2)  # disabled

# ---- group: Exterior Concrete Walls (continued)
ln_10 = Line(StartPoint=item_12.Item, EndPoint=item_12.Item1)  # disabled
merge_7 = Merge(Data1=flatten(arc_13.Arc), Data2=flatten(ln_10))  # -> graft(Result); disabled

# ----
simplify_9 = SimplifyCurve(Curve=merge_7)  # -> simplify(Curve), Simplified; disabled

# ---- group: Exterior Concrete Walls (continued)
wallcrv_5 = AddWallCurve(
    Curve=simplify_9.Curve,
    Type=<hostobjecttype referenced from the Revit model>,
    Height=graft(merge_4),
    LocationLine=wll_3,
    AllowJoins=toggle,
    TrackingMode=2)  # disabled

# ==== cluster BrepTopBoundary
B = ClusterInput()
debrep = DeconstructBrep(Brep=B)  # -> Faces, Edges, Vertices
md_slider = MDSlider(SliderMode=0, slider_value=Point(0.5, 0.5, 0.5), x_domain=Domain(0, 1), y_domain=Domain(0, 1), z_domain=Domain(0, 1))
evalsrf = EvaluateSurface(Surface=reparameterize(debrep.Faces), Point=md_slider)  # -> Point, Normal, UDirection, VDirection, Frame
devec = DeconstructVector(Vector=evalsrf.Normal)  # -> XComponent, YComponent, simplify(ZComponent)
panel = Panel(evalsrf.Normal)
equals = Equality(FirstNumber=expr("round(x)", devec.ZComponent), SecondNumber=1)  # -> Equality, Inequality
cull = CullPattern(List=debrep.Faces, CullPattern=equals.Equality)
edges = BrepEdges(Brep=cull)  # -> Naked, Interior, NonManifold
join = JoinCurves(Curves=edges.Naked, Preserve=False)
C = ClusterOutput(join)
L = ClusterOutput(cull)

# ==== cluster GetLargestFaces
B = ClusterInput()

debrep = DeconstructBrep(Brep=B)  # -> Faces, Edges, Vertices
area = Area(Geometry=debrep.Faces)  # -> Area, Centroid
sort = SortList(Keys=area.Area, ValuesA=debrep.Faces)  # -> Keys, ValuesA
rev = ReverseList(List=sort.ValuesA)
item = ListItem(List=rev, Index=0, Wrap=True)  # -> Item, Item1

i = ClusterOutput(item.Item)
item_1 = ClusterOutput(item.Item1)

# ==== cluster GetBottomFace
B = ClusterInput()
debrep = DeconstructBrep(Brep=B)  # -> Faces, Edges, Vertices
md_slider = MDSlider(SliderMode=0, slider_value=Point(0.5, 0.5, 0.5), x_domain=Domain(0, 1), y_domain=Domain(0, 1), z_domain=Domain(0, 1))
evalsrf = EvaluateSurface(Surface=reparameterize(debrep.Faces), Point=md_slider)  # -> Point, Normal, UDirection, VDirection, Frame
devec = DeconstructVector(Vector=evalsrf.Normal)  # -> XComponent, YComponent, simplify(ZComponent)
equals = Equality(FirstNumber=expr("round(x)", devec.ZComponent), SecondNumber=-1)  # -> Equality, Inequality
cull = CullPattern(List=debrep.Faces, CullPattern=equals.Equality)
L = ClusterOutput(cull)

# ==== cluster GetLongestEdgeCurves
B = ClusterInput()
edges = BrepEdges(Brep=B)  # -> Naked, Interior, NonManifold
len = Length(Curve=edges.Naked)
sort = SortList(Keys=len, ValuesA=edges.Naked)  # -> Keys, ValuesA
rev = ReverseList(List=sort.ValuesA)
item = ListItem(List=rev, Index=0, Wrap=True)  # -> Item, Item1
i = ClusterOutput(item.Item)
item_1 = ClusterOutput(item.Item1)

# ==== cluster Convert2Arc
C = ClusterInput()
curvepoint = PointOnCurve(C, parameter=0.5)
end = EndPoints(Curve=C)  # -> Start, End
arc = Arc3Pt(PointA=end.Start, PointB=curvepoint, PointC=end.End)  # -> Arc, Plane, Radius
A = ClusterOutput(arc.Arc)

# ==== cluster RebuildMidArc
C = ClusterInput()
C_2 = ClusterInput()
eval = EvaluateCurve(Curve=reparameterize(C), Parameter=[0, 0.5, 1])  # -> Point, Tangent, Angle
crv_cp = CurveClosestPoint(Point=eval.Point, Curve=C_2)  # -> Point, Parameter, Distance
ln = Line(StartPoint=eval.Point, EndPoint=crv_cp.Point)
midpt = CurveMiddle(Curve=ln)
item = ListItem(List=midpt, Index=0, Wrap=True)  # -> Item, Item1, Item2
i = ClusterOutput(item.Item)
item_1 = ClusterOutput(item.Item1)
item_2 = ClusterOutput(item.Item2)

# ==== cluster GetWallHeight
C = ClusterInput()
bbox = BoundingBox(Content=C, Plane=PlaneXY(0, 0, 0))  # -> Box, Box_2
box_corners = BoxCorners(Box=bbox.Box)  # -> CornerA, CornerB, CornerC, CornerD, CornerE, CornerF, CornerG, CornerH
dist = Distance(PointA=box_corners.CornerA, PointB=box_corners.CornerE)
expression = Expression(x=dist, Expression="Round(x,2)")
R = ClusterOutput(expression)

# ==== cluster TweenSurface
G = ClusterInput()
G_2 = ClusterInput()
area = Area(Geometry=G)  # -> Area, Centroid
area_2 = Area(Geometry=G_2)  # -> Area, Centroid
ln = Line(StartPoint=area.Centroid, EndPoint=area_2.Centroid)
midpt = CurveMiddle(Curve=ln)
orient = Orient(Geometry=G, Source=area.Centroid, Target=midpt)  # -> Geometry, Transform
G_3 = ClusterOutput(orient.Geometry)

# ==== cluster BrepBottomBoundary
B = ClusterInput()
debrep = DeconstructBrep(Brep=B)  # -> Faces, Edges, Vertices
md_slider = MDSlider(SliderMode=0, slider_value=Point(0.5, 0.5, 0.5), x_domain=Domain(0, 1), y_domain=Domain(0, 1), z_domain=Domain(0, 1))
evalsrf = EvaluateSurface(Surface=reparameterize(debrep.Faces), Point=md_slider)  # -> Point, Normal, UDirection, VDirection, Frame
N = ClusterOutput(evalsrf.Normal)
devec = DeconstructVector(Vector=evalsrf.Normal)  # -> XComponent, YComponent, simplify(ZComponent)
equals = Equality(FirstNumber=expr("round(x)", devec.ZComponent), SecondNumber=-1)  # -> Equality, Inequality
cull = CullPattern(List=debrep.Faces, CullPattern=equals.Equality)
L = ClusterOutput(cull)
