# Grasshopper definition Mass Importing.gh (Grasshopper 1.0.7)
# plug-ins: Rhino.Inside for Autodesk Revit, Pufferfish, Human

height_of_story = Slider(12, range=0..100)
number_of_stories_bldg_a = Slider(12, range=0..25)
number_of_stories_bldg_b = Slider(4, range=0..25)
number_of_stories_bldg_c = Slider(12, range=0..25)
parking_distance_from_pl = Slider(12, range=0..100)
number_of_parking_stories = Slider(2, range=0..25)
parking_coeficient = Slider(600, range=0..600)
number_of_commercial_stories = Slider(1, range=0..25)
net_residential_coeficient = Slider(50, range=0..100, expression="x/100")
typical_unit_size = Slider(500, range=0..2000)
open_space_requirements_per_unit = Slider(150, range=0..1000)
property_boundary = Curve(<curve referenced from the Rhino model>)
building_a = Curve(<curve referenced from the Rhino model>)
building_b = Curve(<curve referenced from the Rhino model>)
building_c = Curve(<curve referenced from the Rhino model>)

expression = Expression(x=height_of_story, y=number_of_stories_bldg_a, Expression="x*y")
expression_2 = Expression(x=height_of_story, y=number_of_stories_bldg_b, Expression="x*y")
expression_3 = Expression(x=height_of_story, y=number_of_stories_bldg_c, Expression="x*y")
Z = UnitZ(Factor=expression)
Z_2 = UnitZ(Factor=expression_2)
Z_3 = UnitZ(Factor=expression_3)
extr = Extrude(Base=building_a, Direction=Z)
extr_2 = Extrude(Base=building_b, Direction=Z_2)
extr_3 = Extrude(Base=building_c, Direction=Z_3)

# ---- group: Topography
property_line = Curve(property_boundary)
disc = Discontinuity(Curve=property_line, Level=1)  # -> Points, Parameters
conmesh = ConstructMesh(Vertices=disc.Points, Faces={A=0, B=1, C=2, D=3})
topography = AddTopographyMesh(Mesh=conmesh, TrackingMode=2)

# ----
Z_4 = UnitZ(Factor=expr("-x", height_of_story))
merge = Merge(Data1=building_a, Data2=building_b, Data3=building_c)
merge_2 = Merge(Data1=extr, Data2=extr_2, Data3=extr_3)
area = Area(Geometry=merge)  # -> expr("round(x)", Area), Centroid
cap = CapHoles(Brep=merge_2)
area_2 = Area(Geometry=property_boundary)  # -> Area, Centroid
ma = MassAddition(Input=area.Area)  # -> Result, PartialResults
Z_5 = UnitZ(Factor=expr("x-0.25", height_of_story))
subtraction = Subtraction(A=area_2.Area, B=ma.Result)
expression_4 = Expression(x=subtraction, Expression="round(x)")
model = ModelCategoriesPicker({"Abutments": -2006130, "Air Systems": -2001008, "Air Terminals": -2008013, "Analysis Display Style": -2000304, "Analysis Results": -2000303, "Areas": -2003200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}, selected="Walls": -2000011)
brep = Brep(merge_2)
bbox = BoundingBox(Content=brep, Plane=PlaneXY(0, 0, 0), UnionBox=True)  # -> Box, Box_2

contour = Contour(Shape=bbox.Box, Point=Point(0, 0, 0), Direction=Vector(0, 0, 1), Distance=height_of_story)  # -> flatten(Contours)
area_3 = Area(Geometry=contour)  # -> Area, Centroid
pdecon = Deconstruct(Point=area_3.Centroid)  # -> XComponent, YComponent, ZComponent
lng = ListLength(List=pdecon.ZComponent)

contour_2 = Contour(Shape=brep, Point=Point(0, 0, 0), Direction=Vector(0, 0, 1), Distance=Slider(12, range=0..100))
crv = Curve(contour_2)

debrep = DeconstructBrep(Brep=brep)  # -> Faces, Edges, Vertices

md_slider = MDSlider(SliderMode=0, slider_value=Point(0.5, 0.5, 0.5), x_domain=Domain(0, 1), y_domain=Domain(0, 1), z_domain=Domain(0, 1))
evalsrf = EvaluateSurface(Surface=reparameterize(debrep.Faces), Point=md_slider)  # -> Point, Normal, UDirection, VDirection, Frame
devec = DeconstructVector(Vector=evalsrf.Normal)  # -> XComponent, YComponent, ZComponent
equals = Equality(FirstNumber=devec.ZComponent, SecondNumber=0)  # -> Equality, Inequality

explode = Explode(Curve=crv, Recursive=True)  # -> Segments, Vertices
reb = RebuildCurve(Curve=explode.Segments, Degree=1, Count=2, Tangents=True)
join = JoinCurves(Curves=reb, Preserve=False)

rebcrv = RebuildCurve(Curve=explode.Segments, Degree=1, EndTangents=False)

# ---- group: Name the Level
series = Series(Start=0, Step=1, Count=lng)
level_name_python = GhPythonScript(y=series)  # -> a
# ---------- level_name_python: Python ----------
__author__ = "Brooks Scarpa"
__version__ = "2022.08.08"

import rhinoscriptsyntax as rs

a = "Floor {}".format(str(y))
# ---------- end level_name_python ----------

# ----
toggle = BooleanToggle(True)
cull = CullPattern(List=debrep.Faces, CullPattern=equals.Equality)

# ---- group: Grid Creation
edges = BrepEdges(Brep=cull)  # -> simplify(Naked), Interior, NonManifold; disabled
curvepoint = PointOnCurve(edges.Naked, parameter=0.5)  # disabled
pdecon_2 = Deconstruct(Point=curvepoint)  # -> XComponent, YComponent, ZComponent; disabled
sort = SortList(Keys=pdecon_2.ZComponent, ValuesA=edges.Naked)  # -> Keys, ValuesA; disabled
item = ListItem(List=sort.ValuesA, Index=0, Wrap=True)  # disabled
grid = AddGrid(Curve=item, TrackingMode=2)  # disabled

# ----
level = AddLevel(Elevation=pdecon.ZComponent, Name=level_name_python, TrackingMode=2)  # disabled
floor = AddFloor(Boundary=graft(join), Type=<hostobjecttype referenced from the Revit model>, TrackingMode=2)  # disabled

wires = BrepWireframe(Brep=cull, Density=-1)
join_2 = JoinCurves(Curves=wires, Preserve=False)
explode_2 = Explode(Curve=join_2, Recursive=True)  # -> Segments, Vertices
reb_2 = RebuildCurve(Curve=explode_2.Segments, Degree=1, Count=2, Tangents=True)
join_3 = JoinCurves(Curves=reb_2, Preserve=False)  # -> simplify(Curves)

facades = Surface(cull)

# ---- group: Area Calcs
area_4 = Area(Geometry=join)  # -> expr("round(x,0)", Area), Centroid
ma_2 = MassAddition(Input=flatten(area_4.Area))  # -> Result, PartialResults

# ----
floors = Curve(join)
trim = TrimTree(Tree=simplify(floors), Depth=1)
split = SplitList(List=trim, Index=number_of_commercial_stories)  # -> ListA, ListB
commercial_levels = Curve(split.ListA)
residential_levels = Curve(split.ListB)

# ---- group: Area Calcs
area_5 = Area(Geometry=split.ListA)  # -> expr("round(x,0)", Area), Centroid
ma_3 = MassAddition(Input=flatten(area_5.Area))  # -> Result, PartialResults

area_6 = Area(Geometry=split.ListB)  # -> expr("round(x,0)", Area), Centroid
ma_4 = MassAddition(Input=flatten(area_6.Area))  # -> Result, PartialResults

# ----
Z_6 = UnitZ(Factor=height_of_story)
Z_7 = UnitZ(Factor=height_of_story)
extr_4 = Extrude(Base=residential_levels, Direction=Z_6)
extr_5 = Extrude(Base=commercial_levels, Direction=Z_7)
multiplication = Multiplication(A=ma_4.Result, B=net_residential_coeficient)
expression_5 = Expression(x=multiplication, y=typical_unit_size, Expression="round(x/y)")
expression_6 = Expression(x=expression_5, y=open_space_requirements_per_unit, Expression="round(x*y)")
site = Mesh(conmesh)
cap_2 = CapHoles(Brep=extr_4)
cap_3 = CapHoles(Brep=extr_5)
site_devlelopment = Panel(expression_4)
gross_commercial_area = Panel(ma_3.Result)
gross_residential_area = Panel(ma_4.Result)
net_residential_area = Panel(multiplication)
overall_gross_area = Panel(ma_2.Result)
total_no_units = Panel(expression_5)
swatch = ColourSwatch(SwatchColor=RGB(154, 186, 237))
swatch_2 = ColourSwatch(SwatchColor=RGB(117, 250, 105))
previewmat = CustomPreviewMaterials(Geometry=cap_2, DiffuseColor=swatch, Transparency=0)
preview = CustomPreview(Geometry=cap_2, Material=swatch)
preview_2 = CustomPreview(Geometry=cap_3, Material=swatch_2)
preview_3 = CustomPreview(Geometry=site, Material=ColourSwatch(SwatchColor=RGB(135, 132, 66)))

# ---- group: Parking Calcs
expression_7 = Expression(x=height_of_story, y=number_of_parking_stories, Expression="x*y")
Z_8 = UnitZ(Factor=expression_7)
offset = OffsetCurve(Curve=property_boundary, Distance=expr("-x", parking_distance_from_pl), Corners=1)
extr_6 = Extrude(Base=offset, Direction=expr("-x", Z_8))

contour_3 = Contour(Shape=extr_6, Point=Point(0, 0, 0), Direction=Vector(0, 0, 1), Distance=height_of_story)  # -> flatten(Contours)
crv_2 = Curve(contour_3)

# ----
extr_7 = Extrude(Base=contour_3, Direction=Z_4)
cap_4 = CapHoles(Brep=extr_7)

# ---- group: Parking Calcs (continued)
area_7 = Area(Geometry=crv_2)  # -> expr("round(x,0)", Area), Centroid
ma_5 = MassAddition(Input=area_7.Area)  # -> Result, PartialResults
no_of_parking_stalls = Expression(x=ma_5.Result, y=parking_coeficient, Expression="round(x/y)")

# ----
move = Move(Geometry=cap_4, Motion=Z_5)  # -> Geometry, Transform
parking_slabs = Brep(move.Geometry)
floors_2 = Curve(flatten([join, contour_3]))
subt_parking_area = Panel(ma_5.Result)
number_of_parking_stalls = Panel(no_of_parking_stalls)

expression_8 = Expression(x=site_devlelopment, y=Slider(216, range=0..500), Expression="round(x*y)")
expression_9 = Expression(x=net_residential_area, y=Slider(295, range=0..500), Expression="round(x*y)")
expression_10 = Expression(x=subt_parking_area, y=Slider(90, range=0..100), Expression="round(x*y)")
expression_11 = Expression(x=gross_commercial_area, y=Slider(150, range=0..500), Expression="round(x*y)")

curve_display = CSharpScript(Curve=floors_2, Width=Slider(1, range=0..1), Colour=ColourSwatch(SwatchColor=RGB(255, 94, 94)))  # inputs Curve: Curve, Width: Int32, Colour: Color, Dash: String
# ---------- curve_display: C# ----------
    if (Curve == null) return;
    if (Width <= 0) return;

    double[] pattern = ParseDashPattern(Dash);
    IEnumerable<Curve> segments = ApplyDashPattern(Curve, pattern);

    _clip = BoundingBox.Union(_clip, Curve.GetBoundingBox(false));
    foreach (Curve segment in segments)
    {
      _curves.Add(segment);
      _colors.Add(Colour);
      _widths.Add(Width);
    }
# ---------- curve_display: C# additional code ----------
  /// <summary>
  /// Parse a dash pattern.
  /// </summary>
  /// <param name="pattern">Pattern to parse.</param>
  /// <returns>Array of dashes and gaps.</returns>
  private double[] ParseDashPattern(string pattern)
  {
    if (string.IsNullOrWhiteSpace(pattern))
      return null;

    string[] fragments = pattern.Split(new char[] {' '});
    if (fragments == null || fragments.Length == 0)
      return null;

    double[] values = new double[fragments.Length];
    for (int i = 0; i < fragments.Length; i++)
    {
      double v;
      if (!double.TryParse(fragments[i], out v))
        throw new Exception(fragments[i] + " is a not a valid number.");

      if (v <= 0.0)
        throw new Exception("Dashes or gaps must have a strictly positive length.");

      values[i] = v;
    }

    return values;
  }
  /// <summary>
  /// Apply a dash+gap pattern to a curve.
  /// </summary>
  private IEnumerable<Curve> ApplyDashPattern(Curve curve, double[] pattern)
  {
    if (pattern == null || pattern.Length == 0)
      return new Curve[] { curve };

    double curveLength = curve.GetLength();
    List<Curve> dashes = new List<Curve>();

    double offset0 = 0.0;
    int index = 0;
    while(true)
    {
      // Get the current dash length.
      double dashLength = pattern[index++];
      if (index >= pattern.Length)
        index = 0;

      // Compute the offset of the current dash from the curve start.
      double offset1 = offset0 + dashLength;
      if (offset1 > curveLength)
        offset1 = curveLength;

      // Solve the curve parameters at the current dash start and end.
      double t0, t1;
      curve.LengthParameter(offset0, out t0);
      curve.LengthParameter(offset1, out t1);

      Curve dash = curve.Trim(t0, t1);
      if (dash != null)
        dashes.Add(dash);

      // Get the current gap length.
      double gapLength = pattern[index++];
      if (index >= pattern.Length)
        index = 0;

      // Set the start of the next dash to be the end of the current
      // dash + the length of the adjacent gap.
      offset0 = offset1 + gapLength;

      // Abort when we've reached the end of the curve.
      if (offset0 >= curveLength)
        break;
    }

    return dashes;
  }

  private BoundingBox _clip;
  private readonly List<Curve> _curves = new List<Curve>();
  private readonly List<Color> _colors = new List<Color>();
  private readonly List<int> _widths = new List<int>();

  /// <summary>
  /// This method will be called once every solution, before any calls to RunScript.
  /// </summary>
  public override void BeforeRunScript()
  {
    _clip = BoundingBox.Empty;
    _curves.Clear();
    _colors.Clear();
    _widths.Clear();
  }

  /// <summary>
  /// Return a BoundingBox that contains all the geometry you are about to draw.
  /// </summary>
  public override BoundingBox ClippingBox
  {
    get { return _clip; }
  }
  /// <summary>
  /// Draw all wires and points in this method.
  /// </summary>
  public override void DrawViewportWires(IGH_PreviewArgs args)
  {
    for (int i = 0; i < _curves.Count; i++)
      args.Display.DrawCurve(_curves[i], _colors[i], _widths[i]);
  }
# ---------- end curve_display ----------

python = GhPythonScript(Name="Total Parking Stalls", No=number_of_parking_stalls)  # -> Name_Out, No_Out
# ---------- python: Python ----------
__author__ = "ilouh"
__version__ = "2022.08.15"

import rhinoscriptsyntax as rs
import locale

No = int(No)



Name_Out = str(Name)
No_Out = '{:,}'.format(No)
# ---------- end python ----------
python_2 = GhPythonScript(Name="Overall Gross Area", No=overall_gross_area)  # -> Name_Out, No_Out
# ---------- python_2: Python ----------
__author__ = "ilouh"
__version__ = "2022.08.15"

import rhinoscriptsyntax as rs
import locale

No = int(No)



Name_Out = str(Name)
No_Out = '{:,} SF'.format(No)
# ---------- end python_2 ----------
python_3 = GhPythonScript(Name="No. Units", No=total_no_units)  # -> Name_Out, No_Out; same code as python

preview_4 = CustomPreview(Geometry=parking_slabs, Material=ColourSwatch(SwatchColor=RGB(200, 195, 212)))
ma_6 = MassAddition(Input=[expression_10, expression_11, expression_9, expression_8])  # -> Result, PartialResults

python_4 = GhPythonScript(Name="Subt Parking Area", Cost=expression_10, Area=subt_parking_area)  # -> Name_Out, Area_Out, Cost_Out; inputs Area: Int32
# ---------- python_4: Python ----------
__author__ = "ilouh"
__version__ = "2022.08.15"

import rhinoscriptsyntax as rs
import locale

Cost = int(Cost)
Area = int(Area) 


Name_Out = str(Name)
Cost_Out = 'Cost: ${:,}'.format(Cost)
Area_Out = 'Area: {:,} SF'.format(Area)
# ---------- end python_4 ----------
python_5 = GhPythonScript(Name="Gross Commercial Area", Cost=expression_11, Area=gross_commercial_area)  # -> Name_Out, Area_Out, Cost_Out; inputs Area: Int32; same code as python_4
python_6 = GhPythonScript(Name="Net Residential Area", Cost=expression_9, Area=net_residential_area)  # -> Name_Out, Area_Out, Cost_Out; inputs Area: Int32; same code as python_4
python_7 = GhPythonScript(Name="Site Development", Cost=expression_8, Area=site_devlelopment)  # -> Name_Out, Area_Out, Cost_Out; inputs Area: Int32; same code as python_4
python_8 = GhPythonScript(Name="Total Site Development Cost", Cost=ma_6.Result)  # -> Name_Out, Cost_Out
# ---------- python_8: Python ----------
__author__ = "ilouh"
__version__ = "2022.08.15"

import rhinoscriptsyntax as rs
import locale

Cost = int(Cost)



Name_Out = str(Name)
Cost_Out = 'Cost: ${:,}'.format(Cost)
# ---------- end python_8 ----------

panel = Panel([python_4.Name_Out, python_4.Area_Out, python_4.Cost_Out])
panel_2 = Panel([python_5.Name_Out, python_5.Area_Out, python_5.Cost_Out])
panel_3 = Panel([python_6.Name_Out, python_6.Area_Out, python_6.Cost_Out])
panel_4 = Panel([python_7.Name_Out, python_7.Area_Out, python_7.Cost_Out])
panel_5 = Panel([python_8.Name_Out, python_8.Cost_Out])
merge_3 = Merge(Data1=panel, Data3=panel_2, Data5=panel_3, Data7=panel_4, Data9=panel_5)  # -> reverse(Result)

panel_6 = Panel([python_3.Name_Out, python_3.No_Out])
panel_7 = Panel([python.Name_Out, python.No_Out])
panel_8 = Panel([python_2.Name_Out, python_2.No_Out])
merge_4 = Merge(Data1=panel_7, Data3=panel_8, Data5=panel_6)  # -> reverse(Result)

# ---- group: Text Settings
lng_2 = ListLength(List=merge_3)  # -> expr("x", Length)
lng_3 = ListLength(List=merge_4)  # -> expr("x", Length)
disc_2 = Discontinuity(Curve=property_boundary, Level=1)  # -> Points, Parameters
disc_3 = Discontinuity(Curve=property_boundary, Level=1)  # -> Points, Parameters
series_2 = Series(Start=Slider(145, range=0..1000), Step=Slider(10, range=0..10), Count=lng_2)
item_2 = ListItem(List=disc_2.Points, Index=0, Wrap=True)
series_3 = Series(Start=Slider(335, range=0..1000), Step=Slider(10, range=0..10), Count=lng_3)
item_3 = ListItem(List=disc_3.Points, Index=0, Wrap=True)
number_slider = Slider(9, range=0..100)
fonts = FontTable()
Z_9 = UnitZ(Factor=series_2)
Z_10 = UnitZ(Factor=series_3)
item_4 = ListItem(List=fonts, Index=11, Wrap=True)
move_2 = Move(Geometry=item_2, Motion=Z_9)  # -> Geometry, Transform
move_3 = Move(Geometry=item_3, Motion=Z_10)  # -> Geometry, Transform
screentext = ScreenOrientedText(Text=merge_3, Font=item_4, Justification=7, Location=move_2.Geometry, SizeFactor=number_slider, Depth=0, Absolute=False)
screentext_2 = ScreenOrientedText(Text=merge_4, Font=item_4, Justification=7, Location=move_3.Geometry, SizeFactor=number_slider, Depth=0, Absolute=False)

# ----
residential_floors = Brep(cap_2)
commerical_floors = Brep(cap_3)
parking_floors = Brep(parking_slabs)

panel_9 = Panel("22000.0 - Residential Floors")
categories = DirectShapeCategories("autodesk.revit.category.family:mass-1.0.0", SearchPattern="Mass")
material = AddMaterial(Name=panel_9, TrackingMode=2)
graphics = MaterialGraphics(Material=material, Color=swatch)  # -> Material, UseRenderAppearance, Color, Transparency, SurfaceForegroundPattern, SurfaceForegroundColor, SurfaceBackgroundPattern, SurfaceBackgroundColor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
geodshape = AddGeometryDirectShape(Name=panel_9, Category=categories, Geometry=flatten(residential_floors), Material=graphics.Material, TrackingMode=2)

panel_10 = Panel("22000.0 - Parking Slabs")
categories_2 = DirectShapeCategories("autodesk.revit.category.family:mass-1.0.0", SearchPattern="Mass")
material_2 = AddMaterial(Name=panel_10, TrackingMode=2)
graphics_2 = MaterialGraphics(Material=material_2, Color=swatch_2)  # -> Material, UseRenderAppearance, Color, Transparency, SurfaceForegroundPattern, SurfaceForegroundColor, SurfaceBackgroundPattern, SurfaceBackgroundColor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
geodshape_2 = AddGeometryDirectShape(Name=panel_10, Category=categories_2, Geometry=flatten(parking_floors), Material=graphics_2.Material, TrackingMode=2)

panel_11 = Panel("22000.0 - Commercial Floors")
categories_3 = DirectShapeCategories("autodesk.revit.category.family:mass-1.0.0", SearchPattern="Mass")
material_3 = AddMaterial(Name=panel_11, TrackingMode=2)
graphics_3 = MaterialGraphics(Material=material_3, Color=swatch_2)  # -> Material, UseRenderAppearance, Color, Transparency, SurfaceForegroundPattern, SurfaceForegroundColor, SurfaceBackgroundPattern, SurfaceBackgroundColor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
geodshape_3 = AddGeometryDirectShape(Name=panel_11, Category=categories_3, Geometry=flatten(commerical_floors), Material=graphics_3.Material, TrackingMode=2)

net_residential_area_2 = Panel([python_6.Name_Out, net_residential_area, expression_9])
gross_commercial_area_2 = Panel([python_5.Name_Out, gross_commercial_area, expression_11])
panel_12 = Panel(["Subt Parking Area", subt_parking_area, expression_10])
item_5 = ListItem(List=net_residential_area_2, Index=0, Wrap=True)  # -> Item, Item1, Item2
item_6 = ListItem(List=gross_commercial_area_2, Index=0, Wrap=True)  # -> Item, Item1, Item2
item_7 = ListItem(List=panel_12, Index=0, Wrap=True)  # -> Item, Item1, Item2
param = ElementParameter(Element=geodshape_3, Parameter="Mass Function", Value=item_6.Item)  # -> Element, Value
param_2 = ElementParameter(Element=geodshape_3, Parameter="Mass Floor Area", Value=item_6.Item1)  # -> Element, Value
param_3 = ElementParameter(Element=geodshape_3, Parameter="Mass Construction Cost", Value=item_6.Item2)  # -> Element, Value
param_4 = ElementParameter(Element=geodshape_2, Parameter="Mass Function", Value=item_7.Item)  # -> Element, Value
param_5 = ElementParameter(Element=geodshape_2, Parameter="Mass Floor Area", Value=item_7.Item1)  # -> Element, Value
param_6 = ElementParameter(Element=geodshape_2, Parameter="Mass Construction Cost", Value=item_7.Item2)  # -> Element, Value
param_7 = ElementParameter(Element=geodshape_2, Parameter="Mass No of Units", Value=number_of_parking_stalls)  # -> Element, Value
param_8 = ElementParameter(Element=geodshape, Parameter="Mass Function", Value=item_5.Item)  # -> Element, Value
param_9 = ElementParameter(Element=geodshape, Parameter="Mass Floor Area", Value=item_5.Item1)  # -> Element, Value
param_10 = ElementParameter(Element=geodshape, Parameter="Mass Construction Cost", Value=item_5.Item2)  # -> Element, Value
param_11 = ElementParameter(Element=geodshape, Parameter="Mass No of Units", Value=total_no_units)  # -> Element, Value

# ---- group: Facade Test
area_8 = Area(Geometry=facades)  # -> Area, Centroid; disabled
sort_2 = SortList(Keys=area_8.Area, ValuesA=facades)  # -> Keys, reverse(ValuesA); disabled
item_8 = ListItem(List=sort_2.ValuesA, Index=0, Wrap=True)  # -> Item, Item1; disabled
merge_5 = Merge(Data1=item_8.Item, Data2=item_8.Item1)  # disabled
dim = Dimensions(Surface=merge_5)  # -> UDimension, VDimension; disabled
expression_12 = Expression(x=dim.UDimension, y=height_of_story, Expression="round(x/(2*y),0)")  # disabled
expression_13 = Expression(x=dim.VDimension, y=height_of_story, Expression="round(x/30,0)")  # disabled
divide = DivideDomain²(Domain=merge_5, UCount=expression_12, VCount=expression_13)  # disabled
subsrf = Isotrim(Surface=simplify(graft(merge_5)), Domain=simplify(divide))  # disabled
number_slider_2 = Slider(12, range=0..100, expression="x/12")  # disabled
neg = Negative(Value=number_slider_2)  # disabled
wires_2 = BrepWireframe(Brep=subsrf, Density=-1)  # disabled
merge_6 = Merge(Data1=number_slider_2, Data2=neg)  # disabled
join_4 = JoinCurves(Curves=wires_2, Preserve=False)  # -> simplify(Curves); disabled
offset_2 = OffsetCurve(Curve=join_4, Distance=merge_6, Corners=1)  # disabled
md_slider_2 = MDSlider(SliderMode=0, slider_value=Point(0.5, 0.5, 0.5), x_domain=Domain(0, 1), y_domain=Domain(0, 1), z_domain=Domain(0, 1))  # disabled
evalsrf_2 = EvaluateSurface(Surface=reparameterize(subsrf), Point=md_slider_2)  # -> Point, Normal, UDirection, VDirection, Frame; disabled
number_slider_3 = Slider(3, range=0..10)  # disabled
amp = Amplitude(Vector=evalsrf_2.Normal, Amplitude=expr("-x", number_slider_3))  # -> graft(Vector); disabled

trim_2 = TrimTree(Tree=offset_2, Depth=1)  # disabled
area_9 = Area(Geometry=trim_2)  # -> Area, Centroid; disabled
sort_3 = SortList(Keys=area_9.Area, ValuesA=trim_2)  # -> Keys, ValuesA; disabled

item_9 = ListItem(List=sort_3.ValuesA, Index=0, Wrap=True)  # disabled
merge_7 = Merge(Data1=join_4, Data2=item_9)  # disabled
loft = Loft(Curves=merge_7, Options={Adjust=False, Closed=False, LoftEnds=0, LoftSimp=0, LoftType=0, Rebuild=10, Refit=0.01})  # disabled
extr_8 = Extrude(Base=loft, Direction=amp)  # disabled
geodshape_4 = AddGeometryDirectShape(
    Category=<geometry referenced from the Revit model>,
    Geometry=extr_8,
    Material=<geometry referenced from the Revit model>,
    TrackingMode=2)  # disabled
