# Grasshopper definition Massing Design Calculator 0.6.1.gh (Grasshopper 1.0.7)
# plug-ins: Human, dotbimGH

# ---- group: Load location of json File
path = FilePath("C:\Users\ilouh\Documents\GitHub\Integrated\data.json")

# ---- group: Proforma for Remodling
building_size = DigitScroller(Scroller_Digits=12, Scroller_Prefix="Building Size", Scroller_Radix=11, Scroller_Value=2696)
cap_rate = DigitScroller(Scroller_Digits=12, Scroller_Prefix="Cap Rate", Scroller_Radix=11, Scroller_Value=5)
construction_cost_per_sf = DigitScroller(Scroller_Digits=12, Scroller_Prefix="Construction Cost Per SF", Scroller_Radix=11, Scroller_Value=225)
net_gross_coef = DigitScroller(Scroller_Digits=12, Scroller_Prefix="Net / Gross Coef", Scroller_Radix=11, Scroller_Value=70)
occupancy_rate = DigitScroller(Scroller_Digits=12, Scroller_Prefix="Occupancy Rate", Scroller_Radix=11, Scroller_Value=100)
purcase_price = DigitScroller(Scroller_Digits=12, Scroller_Prefix="Purcase Price", Scroller_Radix=11, Scroller_Value=559000)
rent_per_sf = DigitScroller(Scroller_Digits=12, Scroller_Prefix="Rent Per SF", Scroller_Radix=10, Scroller_Value=3.2)
sale_per_sf = DigitScroller(Scroller_Digits=12, Scroller_Prefix="Sale Per SF", Scroller_Radix=11, Scroller_Value=625)
soft_costs = DigitScroller(Scroller_Digits=12, Scroller_Prefix="Soft Costs", Scroller_Radix=11, Scroller_Value=15)
python = GhPythonScript(
    building_size=building_size,
    purchase_price=purcase_price,
    cap_rate=cap_rate,
    rpsf=rent_per_sf,
    ppsf=sale_per_sf,
    cpsf=construction_cost_per_sf,
    hard_soft_coef=soft_costs,
    net_coef=net_gross_coef,
    occupancy_rate=occupancy_rate)  # -> dic_keys, dic_values, values_proforma, values_assumptions
# ---------- python: Python ----------
__author__ = "ilouh"
__version__ = "2023.02.21"

import rhinoscriptsyntax as rs
import Grasshopper as gh
import Rhino.Geometry as rg
import ghpythonlib.components as comps
import math
import json


def format_to_dollar_price(value):
    if isinstance(value, (int, float)):
        formatted_value = "${:,.2f}".format(value)
    elif isinstance(value, str):
        # Remove any non-numeric characters
        value = ''.join(filter(str.isdigit, value))
        if value:
            formatted_value = "${:,.2f}".format(float(value)/100)
        else:
            formatted_value = "$0.00"
    else:
        raise TypeError("Unsupported value type. Only int, float, and str are supported.")
    
    return formatted_value

def float_to_percentage(number):
    percentage = number * 100
    formatted_percentage = "{:.2f}%".format(percentage)
    return formatted_percentage

def format_to_sf_area(value):
    if isinstance(value, (int, float)):
        formatted_value = "{:,.2f} SF".format(value)
    else:
        raise TypeError("Unsupported value type. Only int and float are supported.")
    
    return formatted_value

#_______________________________________________________________________________________
# Calculations

construction_cost = building_size * cpsf
soft_cost = construction_cost * (hard_soft_coef / 100)
total_project_cost = purchase_price + construction_cost + soft_cost
gross_monthly_rent = float(rpsf) * building_size * (occupancy_rate/100)
net_motnhly_rent = gross_monthly_rent * (net_coef / 100)
annual_rent = gross_monthly_rent * 12
gross_income = annual_rent
net_income = annual_rent * (net_coef / 100)
valuation = (net_income / (cap_rate / 100))
future_cap_rate = net_income / total_project_cost
sale_value = building_size * ppsf
profit = sale_value - total_project_cost
profit_margin = (sale_value - total_project_cost) / total_project_cost

dict_proforma = {
    'building_size': format_to_sf_area(building_size),
    'purchase_price': format_to_dollar_price(purchase_price),
    'construction_cost': format_to_dollar_price(construction_cost),
    'soft_cost': format_to_dollar_price(soft_cost),
    'total_project_cost': format_to_dollar_price(total_project_cost),
    'gross_monthly_rent': format_to_dollar_price(gross_monthly_rent),
    'net_monthly_rent': format_to_dollar_price(net_motnhly_rent),
    'gross_income': format_to_dollar_price(gross_income),
    'net_income': format_to_dollar_price(net_income),
    'valuation': format_to_dollar_price(valuation),
    'future_cap_rate': float_to_percentage(future_cap_rate),
    'sale_value': format_to_dollar_price(sale_value),
    'profit': format_to_dollar_price(profit),
    'profit_margin': float_to_percentage(profit_margin)
}

dict_assumptions = {

    "cap_rate": float_to_percentage(cap_rate / 100),
    "rent_per_sf": format_to_dollar_price(rpsf),
    "price_per_sf": format_to_dollar_price(ppsf),
    "construction_price_per_sf": format_to_dollar_price(cpsf),
    "soft_cost_allowance": float_to_percentage(hard_soft_coef / 100),
    "net_rental_coef": float_to_percentage(net_coef / 100),
    "occupancy_rate": float_to_percentage(occupancy_rate / 100)
}


keys_list_proforma = [

    'building_size',
    'purchase_price',
    'construction_cost',
    'soft_cost',
    'total_project_cost',
    'gross_monthly_rent',
    'net_monthly_rent',
    'gross_income',
    'net_income',
    'valuation',
    'future_cap_rate',
    'sale_value',
    'profit',
    'profit_margin'


]

keys_list_assumptions = [

    "cap_rate",
    "rent_per_sf",
    "price_per_sf",
    "construction_price_per_sf",
    "soft_cost_allowance",
    "net_rental_coef",
    "occupancy_rate"
]


# Iterate through the keys_list and retrieve corresponding values from the data_dict
values_proforma = []
values_assumptions = []

dic_keys = dict_proforma.keys()
dic_values = dict_proforma.values()


for item in keys_list_proforma:
    values_proforma.append(item + ': ' + str(dict_proforma[item]))

for item in keys_list_assumptions:
    values_assumptions.append(item + ': ' + str(dict_assumptions[item]))

path = "C:\\Users\\ilouh\\Documents\\GitHub\\Integrated\\remodel_proforma.json"
with open(path, 'w') as outfile:
    json.dump(dict_proforma, outfile)
# ---------- end python ----------
panel = Panel("""1
4""")
panel_2 = Panel("")
panel_3 = Panel("""1
5
7
10""")
ins = InsertItems(List=python.values_proforma, Item=panel_2, Indices=panel_3, Wrap=True)
ins_2 = InsertItems(List=python.values_assumptions, Item=panel_2, Indices=panel, Wrap=True)
panel_4 = Panel(ins_2)
panel_5 = Panel(ins)

# ---- group: uses the file name as a an address
c_script = CSharpScript()  # -> A
# ---------- c_script: C# ----------
A = RhinoDocument.Path;
# ---------- end c_script ----------
python_2 = GhPythonScript(path=c_script, json_file_path=path)  # -> address
# ---------- python_2: Python ----------
__author__ = "iliyamuzychuk"

import rhinoscriptsyntax as rs
import re

#path = "/Volumes/GoogleDrive/My Drive/Layouts/2104 S Cochran.3dm"

pattern = r"/(\d+\s[A-Za-z\s]+)\.\w+"  # Regex pattern to match the desired text

match = re.search(pattern, path)

if match:
    address = match.group(1)
    
else:
    print("No match found")
    

import json


with open(json_file_path) as f:
    data = json.load(f)

data['json_schema']['general_information']['address'] = address

#save the json file
with open(json_file_path, 'w') as outfile:
    json.dump(data, outfile)
# ---------- end python_2 ----------

# ----
down_payment = DigitScroller(Scroller_Digits=12, Scroller_Prefix="Down Payment", Scroller_Radix=11, Scroller_Value=35)
interest = DigitScroller(Scroller_Digits=12, Scroller_Prefix="Interest", Scroller_Radix=10, Scroller_Value=8)
term = DigitScroller(Scroller_Digits=12, Scroller_Prefix="Term", Scroller_Radix=11, Scroller_Value=30)
python_3 = GhPythonScript(purchase_price=purcase_price, downpayment=down_payment, interest=interest, term=term)  # -> values
# ---------- python_3: Python ----------
__author__ = "ilouh"
__version__ = "2023.02.21"

import rhinoscriptsyntax as rs
import Grasshopper as gh
import Rhino.Geometry as rg
import ghpythonlib.components as comps
from pprint import pprint
import math 

def format_to_dollar_price(value):
    if isinstance(value, (int, float)):
        formatted_value = "${:,.2f}".format(value)
    elif isinstance(value, str):
        # Remove any non-numeric characters
        value = ''.join(filter(str.isdigit, value))
        if value:
            formatted_value = "${:,.2f}".format(float(value)/100)
        else:
            formatted_value = "$0.00"
    else:
        raise TypeError("Unsupported value type. Only int, float, and str are supported.")
    
    return formatted_value

def float_to_percentage(number):
    percentage = number * 100
    formatted_percentage = "{:.2f}%".format(percentage)
    return formatted_percentage

#_______________________________________________________________________________________

def calc_mortgage(principal, interest, years):
    '''
    given mortgage loan principal, interest(%) and years to pay
    calculate and return monthly payment amount
    '''
    # monthly rate from annual percentage rate
    interest_rate = interest/(100 * 12)
    # total number of payments
    payment_num = years * 12
    # calculate monthly payment
    payment = principal * \
        (interest_rate/(1-math.pow((1+interest_rate), (-payment_num))))
    return payment

def insurance_calculator(principal):
    return (principal * .01) / 12

def property_tax_calculator(purchase_price):
    return (purchase_price * .01) / 12

#_______________________________________________________________________________________

#Mortgage Calculator

purchase_price = purchase_price
downpayment = downpayment / 100
principal = purchase_price * (1 - downpayment)
interest = interest
term = 30

#_______________________________________________________________________________________

principal = purchase_price * (1 - downpayment)
required_downpayment = purchase_price * downpayment

monthly_mortgage = calc_mortgage(principal, interest, term)
monthly_insurance = insurance_calculator(principal)
monthly_property_tax = property_tax_calculator(purchase_price)

total_monthly_payment = monthly_mortgage + monthly_insurance + monthly_property_tax
total_annual_payment = total_monthly_payment * 12

#_______________________________________________________________________________________

#create a dictionary to store the calculated values

data_dict = {

    'purchase_price': format_to_dollar_price(purchase_price),
    'downpayment': float_to_percentage(downpayment),
    'principal': format_to_dollar_price(principal),
    'interest': float_to_percentage(interest/100),
    'term': term,
    'monthly_mortgage': format_to_dollar_price(monthly_mortgage),
    'monthly_insurance': format_to_dollar_price(monthly_insurance),
    'monthly_property_tax': format_to_dollar_price(monthly_property_tax),
    'total_monthly_payment': format_to_dollar_price(total_monthly_payment),
    'total_annual_payment': format_to_dollar_price(total_annual_payment),
    'required_downpayment': format_to_dollar_price(required_downpayment),

}

keys_list = [

    'purchase_price',
    'required_downpayment',
    'principal',
    'interest',
    'term',
    'monthly_mortgage',
    'monthly_insurance',
    'monthly_property_tax',
    'total_monthly_payment',
    'total_annual_payment'
    
]

values = []
for item in keys_list:
    values.append(item + ': ' + str(data_dict[item]))
# ---------- end python_3 ----------
panel_6 = Panel("""2
5
8""")
ins_3 = InsertItems(List=python_3, Item=panel_2, Indices=panel_6, Wrap=True)
panel_7 = Panel(ins_3)

# ---- group: Proforma Calculations
land_value = DigitScroller(Scroller_Digits=12, Scroller_Prefix="Land Value", Scroller_Radix=11, Scroller_Value=1300000)
hard_vs_soft_coef = DigitScroller(Scroller_Digits=12, Scroller_Prefix="Hard vs Soft Coef", Scroller_Radix=11, Scroller_Value=75)
construction_cost_per_sf_2 = DigitScroller(Scroller_Digits=12, Scroller_Prefix="Construction Cost Per SF", Scroller_Radix=11, Scroller_Value=375)
sale_price_per_sf = DigitScroller(Scroller_Digits=12, Scroller_Prefix="Sale Price Per SF", Scroller_Radix=11, Scroller_Value=1044)
cap_rate_2 = DigitScroller(Scroller_Digits=12, Scroller_Prefix="Cap Rate", Scroller_Radix=11, Scroller_Value=5)
net_coefficient = DigitScroller(Scroller_Digits=12, Scroller_Prefix="Net Coefficient", Scroller_Radix=11, Scroller_Value=85)
rent_per_sf_2 = DigitScroller(Scroller_Digits=12, Scroller_Prefix="Rent Per SF", Scroller_Radix=10, Scroller_Value=4.64)

# ----
down_payment_2 = DigitScroller(Scroller_Digits=12, Scroller_Prefix="Down Payment", Scroller_Radix=11, Scroller_Value=20)
interest_2 = DigitScroller(Scroller_Digits=12, Scroller_Prefix="Interest", Scroller_Radix=10, Scroller_Value=8)
term_2 = DigitScroller(Scroller_Digits=12, Scroller_Prefix="Term", Scroller_Radix=11, Scroller_Value=30)
python_4 = GhPythonScript(purchase_price=land_value, downpayment=down_payment_2, interest=interest_2, term=term_2)  # -> values; same code as python_3
panel_8 = Panel("""2
5
8""")
ins_4 = InsertItems(List=python_4, Item=panel_2, Indices=panel_8, Wrap=True)
panel_9 = Panel(ins_4)

# ---- group: Import Mass as PolySurface
massing = Brep(simplify(graft([<brep referenced from the Rhino model> x4])))

# ----
typical_floor_height = DigitScroller(Scroller_Digits=12, Scroller_Prefix="Typical Floor Height", Scroller_Radix=11, Scroller_Value=10)
omit_last_floor_slab = BooleanToggle(True)
panel_10 = Panel("""3
6
10
13""")
cluster = Cluster(massing=massing, typical_floor_height=typical_floor_height, bool=omit_last_floor_slab)  # -> facade_attributes_2, points_facade_attributes, walls_2, roof, floors_2, floor_plate_curves, areas, length_tree
panel_11 = Panel(python.dic_keys)
panel_12 = Panel(python.dic_values)
swatch = ColourSwatch(SwatchColor=RGB(125, 125, 125))
swatch_2 = ColourSwatch(SwatchColor=RGB(0, 0, 0))
output_floors = Brep(cluster.floors_2)

# ---- group: Output - Walls
walls = Surface(simplify(cluster.walls_2))

# ----
output_roof = Brep(cluster.roof)

# ---- group: Output - Floors As Curve
crv = Curve(cluster.floor_plate_curves)

# ----
preview = CustomPreview(Geometry=cluster.walls_2, Material=ColourSwatch(SwatchColor=RGB(191, 191, 191)))
preview_2 = CustomPreview(Geometry=output_roof, Material=swatch)
preview_3 = CustomPreview(Geometry=output_floors, Material=swatch)
screentext = ScreenOrientedText(
    Text=cluster.facade_attributes_2,
    Font="Ariel",
    Justification=7,
    Location=cluster.points_facade_attributes,
    SizeFactor=10,
    Depth=0,
    Absolute=False)
output = DataOutput(
    DataInput=walls,
    Destination="C:\Volumes\GoogleDrive-113227027081246915491\My Drive\Scripting Repository\Exchange Data\FacadeWalls_comm.ghdata",
    RelativePath="C:\Volumes\GoogleDrive-113227027081246915491\My Drive\Scripting Repository\Exchange Data\FacadeWalls_comm.ghdata|..\..\..\..\..\Volumes\GoogleDrive-113227027081246915491\My Drive\Scripting Repository\Exchange Data\FacadeWalls_comm.ghdata")
output_2 = DataOutput(
    DataInput=output_roof,
    Destination="C:\Volumes\GoogleDrive-113227027081246915491\My Drive\Scripting Repository\Exchange Data\Roof_comm.ghdata",
    RelativePath="C:\Volumes\GoogleDrive-113227027081246915491\My Drive\Scripting Repository\Exchange Data\Roof_comm.ghdata|..\..\..\..\..\Volumes\GoogleDrive-113227027081246915491\My Drive\Scripting Repository\Exchange Data\Roof_comm.ghdata")
output_3 = DataOutput(
    DataInput=output_floors,
    Destination="C:\Volumes\GoogleDrive-113227027081246915491\My Drive\Scripting Repository\Exchange Data\Floors_comm.ghdata",
    RelativePath="C:\Volumes\GoogleDrive-113227027081246915491\My Drive\Scripting Repository\Exchange Data\Floors_comm.ghdata|..\..\..\..\..\Volumes\GoogleDrive-113227027081246915491\My Drive\Scripting Repository\Exchange Data\Floors_comm.ghdata")
geo = Geometry([<mesh referenced from the Rhino model> x3])
geo_2 = Geometry(<brep referenced from the Rhino model>)
geo_3 = Geometry(<brep referenced from the Rhino model>)
mesh = Mesh([<mesh referenced from the Rhino model> x3])
cluster_2 = Cluster_2(
    keys=python.dic_keys,
    B=geo_2,
    values=python.dic_values,
    D=ColourSwatch(SwatchColor=RGB(97, 220, 171)),
    B_2=geo_3,
    D_2=ColourSwatch(SwatchColor=RGB(21, 191, 168)),
    M=mesh,
    D_3=ColourSwatch(SwatchColor=RGBA(181, 195, 49, 158)))  # -> info, path_2, R
create_file = CreateFile(ElementsSetsOrElements=cluster_2.R, Info=cluster_2.info, Path=cluster_2.path_2)

# ---- group: Proforma Calculations
total_parking_area = DigitScroller(Scroller_Digits=12, Scroller_Prefix="Total Parking Area", Scroller_Radix=11, Scroller_Value=1200)
construction_cost_per_sf_parking = DigitScroller(Scroller_Digits=12, Scroller_Prefix="Construction Cost Per SF Parking", Scroller_Radix=11, Scroller_Value=125)
python_5 = GhPythonScript(
    hard_soft_coef=hard_vs_soft_coef,
    costruction_costs_per_sf=construction_cost_per_sf_2,
    costruction_costs_per_sf_parking=construction_cost_per_sf_parking,
    sale_price_per_sf=sale_price_per_sf,
    rent_price_per_sf=rent_per_sf_2,
    cap_rate=cap_rate_2,
    net_coef=net_coefficient,
    json_file_path=path)  # -> values
# ---------- python_5: Python ----------
__author__ = "ilouh"
__version__ = "2023.02.21"

import rhinoscriptsyntax as rs
import Grasshopper as gh
import Rhino.Geometry as rg
import ghpythonlib.components as comps
import math



def format_to_dollar_price(value):
    if isinstance(value, (int, float)):
        formatted_value = "${:,.2f}".format(value)
    elif isinstance(value, str):
        # Remove any non-numeric characters
        value = ''.join(filter(str.isdigit, value))
        if value:
            formatted_value = "${:,.2f}".format(float(value)/100)
        else:
            formatted_value = "$0.00"
    else:
        raise TypeError("Unsupported value type. Only int, float, and str are supported.")
    
    return formatted_value

def float_to_percentage(number):
    percentage = number * 100
    formatted_percentage = "{:.2f}%".format(percentage)
    return formatted_percentage

#_______________________________________________________________________________________

# Create a dictionary to store the calculated values

data_dict = {

    'hard_vs_soft_coef': float_to_percentage(hard_soft_coef/100),
    'costruction_costs_per_sf': format_to_dollar_price(costruction_costs_per_sf),
    'costruction_costs_per_sf_parking': format_to_dollar_price(costruction_costs_per_sf_parking),
    'sale_price_per_sf': format_to_dollar_price(sale_price_per_sf),
    'rent_price_per_sf': format_to_dollar_price(rent_price_per_sf),
    'cap_rate': float_to_percentage(cap_rate/100),
    'net_vs_gross_coef': float_to_percentage(net_coef/100)
}

# Create a dataframe from the dictionary

values = []

keys_list = [

    'costruction_costs_per_sf',
    'costruction_costs_per_sf_parking',
    'sale_price_per_sf',
    'rent_price_per_sf',
    'cap_rate',
    'net_vs_gross_coef',
    'hard_vs_soft_coef'
]

for item in keys_list:
    values.append(item + ': ' + str(data_dict[item]))
    

import json


with open(json_file_path) as f:
    data = json.load(f)

data['json_schema']['assumptions'] = data_dict

#save the json file
with open(json_file_path, 'w') as outfile:
    json.dump(data, outfile)
# ---------- end python_5 ----------
panel_13 = Panel("""3
5""")
ins_5 = InsertItems(List=python_5, Indices=panel_13, Wrap=True)
panel_14 = Panel(ins_5)

# ----
python_6 = GhPythonScript(
    areas=cluster.areas,
    total_parking_area=total_parking_area,
    length_tree=cluster.length_tree,
    cpsf=construction_cost_per_sf_2,
    cpsf_parking=construction_cost_per_sf_parking,
    ppsf=sale_price_per_sf,
    rpsf=rent_per_sf_2,
    cap_rate=cap_rate_2,
    net_coef=net_coefficient,
    land_value=land_value,
    hard_soft_coef=hard_vs_soft_coef,
    json_file_path=path)  # -> values, dic_keys, dic_values; inputs areas: list, length_tree: list
# ---------- python_6: Python ----------
__author__ = "ilouh"
__version__ = "2023.02.21"

import rhinoscriptsyntax as rs
import Grasshopper as gh
import Rhino.Geometry as rg
import ghpythonlib.components as comps
import math

#sum a list of numbers
def sum(numbers):
    total = 0
    for n in numbers:
        total += n
    return total


units = len(length_tree)
total_area = sum(areas)

#Functions
def format_to_dollar_price(value):
    if isinstance(value, (int, float)):
        formatted_value = "${:,.2f}".format(value)
    elif isinstance(value, str):
        # Remove any non-numeric characters
        value = ''.join(filter(str.isdigit, value))
        if value:
            formatted_value = "${:,.2f}".format(float(value)/100)
        else:
            formatted_value = "$0.00"
    else:
        raise TypeError("Unsupported value type. Only int, float, and str are supported.")
    
    return formatted_value

def float_to_percentage(number):
    percentage = number * 100
    formatted_percentage = "{:.2f}%".format(percentage)
    return formatted_percentage

def format_to_sf_area(value):
    if isinstance(value, (int, float)):
        formatted_value = "{:,.2f} SF".format(value)
    else:
        raise TypeError("Unsupported value type. Only int and float are supported.")
    
    return formatted_value

#_______________________________________________________________________________________
# Calculations
average_unit_size = total_area / units  # Average size of each unit in square feet
average_rent = float(rpsf) * total_area / units  # Average monthly rent per unit
unit_sale_value = average_unit_size * ppsf  # Sale value of each unit

project_valuation = (average_rent * units * (net_coef / 100) * 12) / (cap_rate / 100)  # Valuation of the project based on net operating income
construction_costs = total_area * cpsf  # Total construction costs for the project
soft_costs = construction_costs * ((100 - hard_soft_coef) / 100)  # Soft costs for the project
total_project_costs = land_value + construction_costs + soft_costs  # Total costs for the project

net_income = total_area * rpsf * (net_coef/100) * 12 

# Create a dictionary to store the calculated values
data_dict = {
    'total__buildbale_area': format_to_sf_area(total_area),
    'total_parking_area': format_to_sf_area(total_parking_area),
    'total_units': units,
    'average_unit_size': format_to_sf_area(average_unit_size),
    'average_unit_rent': format_to_dollar_price(average_rent),
    'average_unit_sale_value': format_to_dollar_price(unit_sale_value),
    'land_value': format_to_dollar_price(land_value),
    'construction_cost': format_to_dollar_price(total_area * cpsf + total_parking_area * cpsf_parking),
    'soft_costs': format_to_dollar_price(soft_costs),
    'total_cost': format_to_dollar_price(total_project_costs),
    'sale_value': format_to_dollar_price(total_area * ppsf),
    'project_valuation': format_to_dollar_price(project_valuation),
    'gross_profit': format_to_dollar_price(total_area * ppsf - total_project_costs),
    'gross_margin': float_to_percentage((total_area * ppsf - total_project_costs) / (total_area * ppsf)),
    'gross_income' : format_to_dollar_price(total_area * rpsf * 12) ,
    'net_income' : format_to_dollar_price(net_income)
}

# Create a list of keys to iterate through
keys_list = [
    'total__buildbale_area',
    'total_parking_area',
    'total_units',
    'average_unit_size',
    'average_unit_rent',
    'average_unit_sale_value',
    'land_value',
    'construction_cost',
    'soft_costs',
    'total_cost',
    'sale_value',
    'project_valuation',
    'gross_profit',
    'gross_margin',
    'gross_income',
    'net_income'
]

# Iterate through the keys_list and retrieve corresponding values from the data_dict
values = []
for item in keys_list:
    values.append(item + ': ' + str(data_dict[item]))

# Print the values
print(values)

dic_keys = data_dict.keys()
dic_values = data_dict.values()

import json

with open(json_file_path) as f:
    data = json.load(f)

data['json_schema']['proforma'] = data_dict

#save the json file
with open(json_file_path, 'w') as outfile:
    json.dump(data, outfile)
# ---------- end python_6 ----------
ins_6 = InsertItems(List=python_6.values, Indices=panel_10, Wrap=True)

# ---- group: Proforma Calculations (continued)
panel_15 = Panel(ins_6)

# ==== cluster Cluster
massing = ClusterInput()
typical_floor_height = ClusterInput()
massing_2 = Brep(graft(massing))
typical_floor_height_2 = Integer(typical_floor_height)

# ---- group: Calculates Building Height
bbox = BoundingBox(Content=massing_2, Plane=PlaneXY(0, 0, 0), UnionBox=True)  # -> Box, Box_2
box_corners = BoxCorners(Box=bbox.Box)  # -> CornerA, CornerB, CornerC, CornerD, CornerE, CornerF, CornerG, CornerH

# ----
Z = UnitZ(Factor=1)
contour = Contour(Shape=massing_2, Point=box_corners.CornerA, Direction=Z, Distance=typical_floor_height_2)  # -> simplify(Contours)
panel = Panel(contour)
floors_as_curves = Curve(contour)

# ---- group: Isolate Faces of Mass
debrep = DeconstructBrep(Brep=massing_2)  # -> Faces, Edges, Vertices
evalsrf = EvaluateSurface(Surface=reparameterize(debrep.Faces), Point="{0.5,0.5,0}")  # -> Point, Normal, UDirection, VDirection, Frame
distributefaces = GhPythonScript(v=evalsrf.Normal, faces=debrep.Faces)  # -> floors, facadeWalls, roof; inputs v: list, faces: list
# ---------- distributefaces: Python ----------
__author__ = "ilouh"
__version__ = "2023.01.08"

import rhinoscriptsyntax as rs
import ghpythonlib.components as comps
import Rhino.Geometry as geom

#elements = comps.DeconstructBrep(mass)
#faces = elements['faces']

#find the normal of each face


roof = []
floors = []
solidWalls = []
facadeWalls = [] 

for i in range(0,len(v)):
    
    
    values = comps.DeconstructVector(v[i])
    print(values)
    
    x_value = values['x_component']
    y_value = values['y_component']
    z_value = values['z_component']
    
    

    if z_value >= 0.4:
        
        print(i)
        roof.append(faces[i])
    
    if z_value == -1:
        
        floors.append(faces[i])
   
    if abs(z_value) != 1:
    
        facadeWalls.append(faces[i])
# ---------- end distributefaces ----------

# ---- group: Pass if Tree or List
flatten = FlattenTree(Tree=floors_as_curves, Path="{0}")
python = GhPythonScript(x=flatten)  # -> a; inputs x: list
# ---------- python: Python ----------
__author__ = "ilouh"
__version__ = "2023.02.21"

import rhinoscriptsyntax as rs
import Grasshopper as gh
import Rhino.Geometry as rg
import ghpythonlib.components as comps
import math

if len(x) > 1:
    a = True
else:
    a = False
# ---------- end python ----------
trim = TrimTree(Tree=floors_as_curves, Depth=1)
flatten_2 = FlattenTree(Tree=floors_as_curves, Path="{0}")
filter = StreamFilter(Gate=python, Stream0=flatten_2, Stream1=trim)

# ----
cls = Closed(Curve=filter)  # -> Closed, Periodic
panel_2 = Panel(cls.Closed)
cull = CullPattern(List=filter, CullPattern=cls.Closed)
srf = Surface(graft(distributefaces.facadeWalls))
srf_2 = Surface(flatten(distributefaces.roof))
srf_3 = Surface(distributefaces.floors)
flatten_3 = FlattenTree(Tree=srf_3, Path="{0}")
trim_2 = TrimTree(Tree=srf, Depth=1)
area = Area(Geometry=flatten_3)  # -> Area, Centroid
bool = ClusterInput()
ma = MassAddition(Input=area.Area)  # -> Result, PartialResults

# ---- group: Calculates Gross Building Area
python_2 = GhPythonScript(Floor_Plate_Curves=cull, bool=bool)  # -> keys, simplify(values), TotalBuildingArea, Floor_Plate_Curves; inputs Floor_Plate_Curves: list of Curve, floorList: list of Int32
# ---------- python_2: Python ----------
__author__ = "Iliya Muzychuk"
__version__ = "2023.02.03"

import rhinoscriptsyntax as rs
import Grasshopper as gh
import Rhino.Geometry as rg
import ghpythonlib.components as comps

FloorNames = []
FloorAreas = []

#Funcition to find the key of a dictionary by value 

def findKey(value_to_find,dic):
    for key, value in dic.items():
        if abs(value - value_to_find) < 2:
            return key
dic = {}
#Create a name and claculates the area of each floor
for i in range(0,len(floorList)):
    floor_number = 1 + i
    dic_name = 'Floor {}'.format(floor_number)
    dic[dic_name] = floorList[i]

print(dic)

if bool == True: 

    Floor_Plate_Curves.pop(-1)

else:
    
    pass

for  floor in Floor_Plate_Curves: 
    
    
    Floor_Area = comps.Area(floor)
    FloorAreas.append(round(Floor_Area['area'],2))

    
    z_value = int(Floor_Area['centroid'][2])
    print(z_value)
    Floor_Name = findKey(z_value,dic)
    
    print(Floor_Name)

    FloorNames.append(Floor_Name)

keys = FloorNames
values = FloorAreas

TotalBuildingArea = sum(values)
# ---------- end python_2 ----------

# ---- group: creates the extrusion distance
floor_thickness = Slider(0.5, range=0..1)
neg = Negative(Value=floor_thickness)
Z_2 = UnitZ(Factor=neg)
extr = Extrude(Base=python_2.Floor_Plate_Curves, Direction=Z_2)
cap = CapHoles(Brep=extr)

# ----
panel_3 = Panel(python_2.TotalBuildingArea)
walls = Surface(simplify(trim_2))

extr_2 = Extrude(Base=srf_2, Direction=Z_2)
cap_2 = CapHoles(Brep=extr_2)

floors = Brep(simplify(cap))
flatten_4 = FlattenTree(Tree=python_2.values, Path="{0}")
tstat = TreeStatistics(Tree=python_2.values)  # -> Length_tree, Length, Count

# ---- group: Outputs
floor_plate_curves = ClusterOutput(python_2.Floor_Plate_Curves)
floors_2 = ClusterOutput(floors)
walls_2 = ClusterOutput(walls)
roof = ClusterOutput(cap_2)

# ----
areas = ClusterOutput(flatten_4)
length_tree = ClusterOutput(tstat.Length_tree)
flatten_5 = FlattenTree(Tree=python_2.TotalBuildingArea, Path="{0}")
graft = GraftTree(Tree=flatten_5, IncludeEmptyLists=True, IncludeNullItems=True)

# ---- group: Calculates Wall Area Ratio
python_3 = GhPythonScript(walls=walls, totalBuildingArea=graft)  # -> keys, values, result; inputs walls: list
# ---------- python_3: Python ----------
__author__ = "Iliya Muzychuk"
__version__ = "2023.02.03"

import rhinoscriptsyntax as rs
import Grasshopper as gh
import Rhino.Geometry as rg
import ghpythonlib.components as comps

#A function to convert a float to percentage

def float_to_percentage(number):
    return '{:.2%}'.format(number)
    
wall_areas = []

for wall in walls:
    
    area = rs.Area(wall)
    wall_areas.append(area)

total_wall_area = round(sum(wall_areas),2)
wall_area_ratio = total_wall_area / totalBuildingArea

#Dictionary constructions allows future json file control 

dic = {

    'Total Facade Area' : total_wall_area,
    'Wall area/Floor area Ratio' : float_to_percentage(wall_area_ratio)

}

keys = dic.keys()
values = dic.values() 

result = []

for key, value in dic.items():
    
    string = str(key) + ": " + str(value)
    result.append(string)
# ---------- end python_3 ----------

# ----
facade_attributes = Data(python_3.result)

lng = ListLength(List=simplify(facade_attributes))
series = Series(Start=0, Step=typical_floor_height_2, Count=lng)

Z_3 = UnitZ(Factor=series)
move = Move(Motion=Z_3)  # -> Points_Facade_Attributes, Transform

points_facade_attributes = ClusterOutput(move.Points_Facade_Attributes)
facade_attributes_2 = ClusterOutput(facade_attributes)

# ==== cluster Cluster_2
M = ClusterInput()
B = ClusterInput()
B_2 = ClusterInput()
mesh = MeshBrep(
    Brep=B,
    Settings={GridMaxCount=0, GridMinCount=16, JaggedSeams=False, MaxEdgeLength=0, MinEdgeLength=0.0001, MinTolerance=0, Refine=True, RefineAngle=0, RelativeTolerance=0.65, SimplePlanes=True, Tolerance=0})
mesh_2 = MeshBrep(
    Brep=B_2,
    Settings={GridMaxCount=0, GridMinCount=16, JaggedSeams=False, MaxEdgeLength=0, MinEdgeLength=0.0001, MinTolerance=0, Refine=True, RefineAngle=0, RelativeTolerance=0.65, SimplePlanes=True, Tolerance=0})
tri = Triangulate(Mesh=mesh)  # -> Mesh, Count
tri_2 = Triangulate(Mesh=mesh_2)  # -> Mesh, Count
tri_3 = Triangulate(Mesh=M)  # -> Mesh, Count
lng = ListLength(List=tri.Mesh)
D = ClusterInput()
python = GhPythonScript(list_length=flatten(tri.Mesh))  # -> simplify(graft(names)); inputs list_length: list
# ---------- python: Python ----------
__author__ = "ilouh"
__version__ = "2023.02.06"


names = []

for i in range(1,len(list_length)+1):
    
    temp = str("element") + ' id. {}'.format(i)
    names.append(temp)
# ---------- end python ----------
lng_2 = ListLength(List=tri.Mesh)
mesh_3 = Mesh(tri_3.Mesh)
dup = DuplicateData(Data=D, Number=lng, Order=True)  # -> graft(Data)
lng_3 = ListLength(List=B)
lng_4 = ListLength(List=tri.Mesh)
D_2 = ClusterInput()
lng_5 = ListLength(List=B_2)
python_2 = GhPythonScript(list_length=flatten(tri_2.Mesh))  # -> simplify(graft(names)); inputs list_length: list; same code as python
D_3 = ClusterInput()
lng_6 = ListLength(List=M)
python_3 = GhPythonScript(list_length=flatten(tri_3.Mesh))  # -> simplify(graft(names)); inputs list_length: list; same code as python
panel = Panel("""Name
Class
Phase
URL
Cost
Rating
Sustainability Rating
Responsibility""")
panel_2 = Panel("""Value A
Value B
Value C
Value D
Value E
Value F
Value G
Value H""")
create_guid = CreateGuid(Count=lng_3)
create_guid_2 = CreateGuid(Count=lng_5)
dup_2 = DuplicateData(Data=D_2, Number=lng_2, Order=True)  # -> graft(Data)
dup_3 = DuplicateData(Data=D_3, Number=lng_4, Order=True)  # -> graft(Data)
create_guid_3 = CreateGuid(Count=lng_6)
create_info = CreateInfo(Keys=panel, Values=panel_2)  # -> simplify(Info)
dup_4 = DuplicateData(Data=create_info, Number=2, Order=True)  # -> graft(Data)
xy = XYPlane(Origin=Point(0, 0, 0))
xy_2 = XYPlane(Origin=Point(0, 0, 0))
xy_3 = XYPlane(Origin=Point(0, 0, 0))
create_elements_set = CreateElementsSet(
    Mesh=simplify(tri.Mesh),
    InsertPlanes=xy,
    Guids=simplify(create_guid),
    Types=simplify(flatten(python)),
    Colors=simplify(flatten(dup)),
    Info=simplify(flatten(dup_4)))  # -> flatten(ElementsSet), Preview
create_elements_set_2 = CreateElementsSet(
    Mesh=simplify(tri_2.Mesh),
    InsertPlanes=xy_2,
    Guids=simplify(create_guid_2),
    Types=simplify(flatten(python_2)),
    Colors=simplify(flatten(dup_2)),
    Info=simplify(flatten(dup_4)))  # -> flatten(ElementsSet), Preview
create_elements_set_3 = CreateElementsSet(
    Mesh=simplify(mesh_3),
    InsertPlanes=xy_3,
    Guids=simplify(create_guid_3),
    Types=simplify(flatten(python_3)),
    Colors=simplify(flatten(dup_3)),
    Info=simplify(flatten(dup_4)))  # -> flatten(ElementsSet), Preview

# ---- group: Creates Path
c_script = CSharpScript()  # -> A
# ---------- c_script: C# ----------
    A = RhinoDocument.Path;
# ---------- end c_script ----------
python_con_path = GhPythonScript(A=c_script)  # -> filename
# ---------- python_con_path: Python ----------
__author__ = "ilouh"
__version__ = "2023.02.21"

import rhinoscriptsyntax as rs
import Grasshopper as gh
import Rhino.Geometry as rg
import ghpythonlib.components as comps
import math

path = "D:/40_Romeo/03_dotBim Files"

import os

filename, extension = os.path.splitext(A)
filename = os.path.basename(filename)

filename = filename + '.bim'

print(filename)
# ---------- end python_con_path ----------
panel_3 = Panel(python_con_path)
concat = Concatenate(FragmentA="D:\40_Romeo\03_dotBim Files", FragmentB="\", FragmentC=panel_3)
path = FilePath(concat)

# ----
merge = Merge(Data1=[create_elements_set_2.ElementsSet, create_elements_set_3.ElementsSet, create_elements_set.ElementsSet])
path_2 = ClusterOutput(path)
R = ClusterOutput(merge)
keys = ClusterInput()
values = ClusterInput()
create_info_2 = CreateInfo(Keys=keys, Values=values)
info = ClusterOutput(create_info_2)
